# Grasshopper definition funnel_shell.gh (Grasshopper 1.0.7)
# plug-ins: Karamba, NGon 2, Sandbox Topology, Human, Weaverbird

# ---- group: Define Cross Sections / Define Materials
matselect = MaterialSelectionKaramba3D(menu=[dropdown(3), dropdown(6)])

# ---- group: Define Cross Sections
range = Range(Domain="5 to 40", Steps=10)
expression = Expression(x="Shell", y=range, Expression="x&\" \"&y")
cross_section = CrossSectionKaramba3D(
    FamilyNameOfCrossSection="Shell",
    NameOfCrossSection=graft(expression),
    Material=matselect,
    Height_cm=graft(range),
    mode="Shell - Const")  # -> flatten(CrossSection)
crosecselect = CrossSectionSelectorKaramba3D(CrossSections=cross_section)  # -> CrossSection, Info

# ----
shell_dimension_x = Slider(4.5, range=0..10)
shell_global_orientation = Slider(0, range=0..1)
shell_dimension_y_m = Slider(6, range=0..10)
num_of_faces_in_x_direction = Slider(60, range=0..100)
num_of_faces_in_y_direction = Slider(80, range=0..120)
num = Number(shell_dimension_x)
num_2 = Number(shell_dimension_y_m)
num_3 = Number(num_of_faces_in_x_direction)
num_4 = Number(num_of_faces_in_y_direction)
num_5 = Number(shell_global_orientation)

# ----
# shell
mesh = Mesh(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)

bbox = BoundingBox(Content=mesh, Plane=PlaneXY(0, 0, 0))  # -> Box, Box_2
project = Project(Geometry=mesh, Plane=PlaneXY(0, 0, 0))  # -> Geometry, Transform
debrep = DeconstructBrep(Brep=bbox.Box)  # -> Faces, Edges, Vertices
num_6 = Number(num_2)
num_7 = Number(num)
demesh = DeconstructMesh(Mesh=project.Geometry)  # -> Vertices, Faces, Colours, Normals
wbedges = WeaverbirdsMeshEdges(MeshOrPolylines=project.Geometry)
item = ListItem(List=reverse(debrep.Faces), Index=0, Wrap=True)
division = Division(A=num_7, B="6")
addition = Addition(A="6", B=1)
division_2 = Division(A=num_6, B="6")
eval = EvaluateCurve(Curve=reparameterize(wbedges), Parameter="0.5")  # -> Point, Tangent, Angle
avr = Average(Input=demesh.Vertices)
series = Series(Start=0, Step=1, Count=addition)
evalsrf = EvaluateSurface(Surface=reparameterize(item), Point="{0.5, 0.5, 0.0}")  # -> Point, Normal, UDirection, VDirection, Frame
xy = XYPlane(Origin=Point(0, 0, 0))
division_3 = Division(A=num_6, B=2)
division_4 = Division(A=num_7, B=2)
multiplication = Multiplication(A=division, B=series)
multiplication_2 = Multiplication(A=division_2, B=series)
cp = ClosestPoint(Point=avr, Cloud=eval.Point)  # -> ClosestPoint, CPIndex, Distance
deplane = DeconstructPlane(Plane=evalsrf.Frame)  # -> Origin, XAxis, YAxis, ZAxis
pt = ConstructPoint(XCoordinate=division_4, YCoordinate=division_3, ZCoordinate=0)
num_8 = Number(num_2)
graft = GraftTree(Tree=multiplication, IncludeEmptyLists=True, IncludeNullItems=True)
item_2 = ListItem(List=wbedges, Index=cp.CPIndex, Wrap=True)
num_9 = Number(num_3)
num_10 = Number(num_4)
num_11 = Number(num)
xy_2 = XYPlane(Origin=Point(0, 0, 0))
xy_3 = XYPlane(Origin=pt)
division_5 = Division(A=num_11, B="2")
division_6 = Division(A=num_8, B="2")
end = EndPoints(Curve=item_2)  # -> Start, End
pt_2 = ConstructPoint(XCoordinate=graft, YCoordinate=multiplication_2, ZCoordinate=0)
neg = Negative(Value=division_5)
neg_2 = Negative(Value=division_6)
vec2pt = Vector2Pt(PointA=end.Start, PointB=end.End, Unitize=False)  # -> Vector, Length
angle = Angle(VectorA=deplane.XAxis, VectorB=vec2pt.Vector, Plane=evalsrf.Frame)  # -> Angle, Reflex
prot = RotatePlane(Plane=evalsrf.Frame, Angle=angle.Angle)
panel = Panel("""1
3
5""")
orient = Orient(Geometry=pt_2, Source=xy_3, Target=xy_2)  # -> Geometry, Transform
dom = ConstructDomain(DomainStart=neg_2, DomainEnd=division_6)
dom_2 = ConstructDomain(DomainStart=neg, DomainEnd=division_5)
panel_2 = Panel("""4
2
4""")
panel_3 = Panel("""4
1
4""")
orient_2 = Orient(Geometry=mesh, Source=prot, Target=xy)  # -> Geometry, Transform
wbedges_2 = WeaverbirdsMeshEdges(MeshOrPolylines=orient_2.Geometry)
mesh_2 = Mesh(orient_2.Geometry)
rectangle = Rectangle(Plane=PlaneXY(0, 0, 0), XSize=dom_2, YSize=dom, Radius=0)  # -> Rectangle, Length
mesh_3 = Mesh(mesh_2)
wbcatmullclark = WeaverbirdsCatmullClarkSubdivision(MeshCurves=mesh_3, Level=1, SmoothNakedEdges=0)
mplane = MeshPlane(Boundary=rectangle.Rectangle, WidthCount=num_9, HeightCount=num_10)  # -> Mesh, Area
pt_3 = Point()
pt_4 = Point()

# ---- group: Define Elements
meshtoshell = MeshToShellKaramba3D(Mesh=wbcatmullclark, Identifier="S", CrossSection=crosecselect.CrossSection, LimitDistance_m=0.005)  # -> Element, Points, Info

# ----
pt_5 = Point(meshtoshell.Points)
pdecon = Deconstruct(Point=pt_5)  # -> XComponent, YComponent, ZComponent
sort = SortList(Keys=pdecon.ZComponent, ValuesA=pt_5)  # -> Keys, ValuesA
dcon = DeleteConsecutive(Set=sort.Keys, Wrap=False)  # -> Set, Count
smaller = SmallerThan(FirstNumber=pdecon.ZComponent, SecondNumber="0.01")  # -> SmallerThan, OrEqualTo
item_3 = ListItem(List=dcon.Set, Index=0, Wrap=True)
smaller_2 = SmallerThan(FirstNumber=sort.Keys, SecondNumber=item_3)  # -> SmallerThan, OrEqualTo
cull_i = CullIndex(List=sort.ValuesA, Indices=smaller_2.OrEqualTo, Wrap=True)
cull = CullPattern(List=sort.ValuesA, CullPattern=smaller_2.OrEqualTo)
pt_6 = Point(cull)
pt_7 = Point(pt_6)

# ---- group: Define Supports
supp = SupportKaramba(PosInd=pt_7, menu=[buttons(on, on, on, off, off, off)])

# ---- group: Define Loads
Z = UnitZ(Factor="-1")
mesh_4 = Mesh(wbcatmullclark)
loads = LoadsKaramba3D(Vector=Vector(0, 0, -1), LCase=0, mode="Gravity")
loads_2 = LoadsKaramba3D(Vector=Z, Mesh=mesh_4, LCase=0, mode="MeshLoad -Const.", menu=[buttons(off, on, off), buttons(on, off)])

# ----
tri = Triangulate(Mesh=mplane.Mesh)  # -> Mesh, Count
number_slider = Slider(0.5, range=0..1)
concrete_covers_cm = Panel("""2.5
2.5
-2.5
-2.5""")
mesh_5 = Mesh(tri.Mesh)
mesh_6 = Mesh(mesh_5)
demesh_2 = DeconstructMesh(Mesh=mesh_6)  # -> Vertices, Faces, Colours, Normals
crv = Curve(rectangle.Rectangle)
crv_2 = Curve(crv)
explode = Explode(Curve=crv_2, Recursive=True)  # -> Segments, Vertices
graft_2 = GraftTree(Tree=explode.Segments, IncludeEmptyLists=True, IncludeNullItems=True)
crv_cp = CurveClosestPoint(Point=demesh_2.Vertices, Curve=graft_2)  # -> Point, Parameter, Distance
smaller_3 = SmallerThan(FirstNumber=crv_cp.Distance, SecondNumber="0.001")  # -> SmallerThan, OrEqualTo
cull_2 = CullPattern(List=crv_cp.Point, CullPattern=smaller_3.SmallerThan)  # -> simplify(List)
split = SplitTree(Data=cull_2, Masks=flatten("{0,2}"))  # -> Positive, Negative
intersection = SetIntersection(SetA=split.Positive, SetB=flatten(split.Negative))  # -> flatten(Union)
difference = SetDifference(SetA=split.Positive, SetB=flatten(intersection))
difference_2 = SetDifference(SetA=split.Negative, SetB=flatten(intersection))
matselect_2 = MaterialSelectionKaramba(menu=[dropdown(3), dropdown(8)])
matselect_3 = MaterialSelectionKaramba(menu=[dropdown(2), dropdown(2)])
num_12 = Number()
mesh_7 = Mesh(mesh_5)
num_13 = Number(num_5)
cps = ClosestPoints(Point=intersection, Cloud=flatten(difference_2), Count="1")  # -> ClosestPoint, CPIndex, Distance

# ---- group: Assemble Model
assemble = AssembleModelKaramba3D(Elem=meshtoshell.Element, Support=flatten(supp), Load=flatten([loads, loads_2]), LimitDistance_m=0.005)  # -> Model, Info, Mass_kg, CenterOfGravity

# ----
rdpoints = RemoveDuplicatePointsKaramba3D(Point=meshtoshell.Points, LimitDistance=0.005)  # -> OutPoint, Info, Indexes
analyze = AnalyzeKaramba3D(Model=assemble.Model)  # -> CalculatedModel, MaximumDisplacement_cm, ResultingForceOfGravity_kN, ElasticEnergy_kNm
shelllineresults = LineResultsOnShellsKaramba3D(
    AnalyzedModel=analyze.CalculatedModel,
    LayerPosition=Slider(0, range=-1..1),
    ListOfSourcesOfPrincipalStressLinesLinesPoints=rdpoints.OutPoint,
    SegmentLength_m=Slider(1, range=0.01..2),
    DA_deg=5,
    mode="PrincStress")  # -> AnalyzedModel, Lines1, Lines2
line = Line(shelllineresults.Lines1)
line_2 = Line(shelllineresults.Lines2)
shellview = ShellViewKaramba3D(Model=analyze.CalculatedModel, IndexOfLayer=0)  # -> Model, MeshesOfRenderedShells, LegendColors, LegendTags
preview = CustomPreview(Geometry=line_2, Shader=ColourSwatch(SwatchColor=RGB(0, 0, 255)))
preview_2 = CustomPreview(Geometry=line, Shader=ColourSwatch(SwatchColor=RGB(255, 0, 0)))

multiplication_3 = Multiplication(A=num_12, B="100")
multiplication_4 = Multiplication(A=concrete_covers_cm, B=2)
panel_4 = Panel(multiplication_3)
cross_sections = CrossSectionsKaramba(
    FamilyNameOfCrossSection="DefaultCroSec",
    MaterialConcrete=matselect_2,
    Height_cm=panel_4,
    MaterialReinforcement=matselect_3,
    ReinforcementConcreteCovers_cm=multiplication_4,
    PrincipalReinforcementDirection_deg=0,
    mode="Shell RC Standard - Const.")
crv_3 = Curve(graft_2)
pt_8 = Point(cull_2)
pt_9 = Point(cps.ClosestPoint)
pt_10 = Point(intersection)
mesh_8 = Mesh(mesh_5)
pt_11 = Point(pt_10)
panel_5 = Panel("""0
1""")
pt_12 = Point(pt_9)  # disabled
meshtoshell_2 = MeshToShellKaramba(Mesh=mesh_7, Identifier="slab", CrossSection=cross_sections, LimitDistance_m=0.005)  # -> Element, Points, Info
pt_13 = Point(meshtoshell_2.Points)
cps_2 = ClosestPoints(Point=pt_4, Cloud=flatten(pt_13), Count="1")  # -> ClosestPoint, CPIndex, Distance
pt_14 = Point(cps_2.ClosestPoint)
pt_15 = Point(pt_14)  # disabled
item_4 = ListItem(List=pt_11, Index="1", Wrap=True)
cull_i_2 = CullIndex(List=pt_11, Indices=panel_5, Wrap=True)  # disabled
supp_2 = SupportKaramba(PosInd=pt_15, menu=[buttons(on, on, on, off, off, off)])
supp_3 = SupportKaramba(PosInd=pt_12, menu=[buttons(off, on, on, off, off, off)])
pt_16 = ConstructPoint(XCoordinate=0, YCoordinate=0, ZCoordinate=0)
vec = VectorXYZ(XComponent="1.0", YComponent=num_13, ZComponent=0)  # -> Vector, Length
supp_4 = SupportKaramba(PosInd=pt_9, menu=[buttons(on, on, on, off, off, on)])
supp_5 = SupportKaramba(PosInd=cull_i_2, menu=[buttons(on, on, on, off, off, off)])
vdisex = VectorDisplayEx(Point=pt_16, Vector=vec.Vector, Colour=RGB(0, 0, 0), Width=2)
orientate = OrientateElemKaramba(Shell=meshtoshell_2.Element, XOrientations=vec.Vector, mode="Shell")
entwine = Entwine(Branch00=supp_2, Branch01=supp_3, Branch02=supp_4, Branch03=supp_5, FlattenInputs=True)
element = ElementKaramba(flatten(orientate))
support = SupportKaramba(flatten(entwine))
element_2 = ElementKaramba(element)
support_2 = SupportKaramba(support)
s_forces = ShellForcesKaramba3D(AnalyzedModel=analyze.CalculatedModel, LCase=0, mode="Principal")  # -> AnalyzedModel, FirstPrincipalNormalForce_kN_m, SecondPrincipalNormalForce_kN_m, FirstPrincipalMoment_kNm_m, SecondPrincipalMoment_kNm_m, ShearForceInLocalXDirection_kN_m, ShearForceInLocalYDirection_kN_m

# ----
# stress vectors
shellvecresults = ResultVectorsOnShellsKaramba3D(AnalyzedModel=analyze.CalculatedModel, LayerPosition=0, mode="PrincStress")  # -> AnalyzedModel, Points, FirstPrincipalStressVector_kN_cm2, SecondPrincipalStressVector_kN_cm2, FirstPrincipalStressValue_kN_cm2, SecondPrincipalStressValue_kN_cm2; disabled
number_slider_2 = Slider(0.125, range=0..1)  # disabled
swatch = ColourSwatch(SwatchColor=RGB(255, 0, 0))  # disabled
swatch_2 = ColourSwatch(SwatchColor=RGB(0, 0, 255))  # disabled
amp = Amplitude(Vector=shellvecresults.FirstPrincipalStressVector_kN_cm2, Amplitude=number_slider_2)  # disabled
amp_2 = Amplitude(Vector=shellvecresults.SecondPrincipalStressVector_kN_cm2, Amplitude=number_slider_2)  # disabled
vdisex_2 = VectorDisplayEx(Point=shellvecresults.Points, Vector=amp, Colour=swatch, Width=2)  # disabled
vdisex_3 = VectorDisplayEx(Point=shellvecresults.Points, Vector=amp_2, Colour=swatch_2, Width=2)  # disabled

model = ModelKaramba3D(analyze.CalculatedModel)
model_2 = ModelKaramba(model)

# ---- group: Optional Colors
range_2 = Range(Domain=Domain(0, 1), Steps=10)
gradient = Gradient(
    LowerLimit=0,
    UpperLimit=1,
    Parameter=range_2,
    stops=[0: RGB(255, 0, 0), 0.176: RGB(255, 238, 0), 0.35: RGB(0, 255, 234), 0.504: RGB(35, 4, 128), 0.664: RGB(0, 252, 215), 0.843: RGB(255, 255, 0), 1: RGB(255, 0, 47)])

# ----
model_3 = ModelKaramba(model)
modelview = ModelViewKaramba(Model=model_3, LoadCaseFactorsForLinearSuperposition=1, IndexOfVisibleLoadcase=-1, ListOfColorsForColoringPlots=gradient)  # -> Model, DeformedMesh, DeformedAxes, DeformedModel
shellview_2 = ShellViewKaramba(Model=modelview.Model, IndexOfLayer=0)  # -> Model, MeshesOfRenderedShells, LegendColors, LegendTags
legend = Legend(Colour=shellview_2.LegendColors, Tags=shellview_2.LegendTags, LegendType=1)

# ---- group: Optional Colors
range_3 = Range(Domain=Domain(0, 1), Steps=10)
gradient_2 = Gradient(
    LowerLimit=0,
    UpperLimit=1,
    Parameter=range_3,
    stops=[0: RGB(255, 0, 0), 0.176: RGB(255, 238, 0), 0.35: RGB(0, 255, 234), 0.504: RGB(35, 4, 128), 0.664: RGB(0, 252, 215), 0.843: RGB(255, 255, 0), 1: RGB(255, 0, 47)])

# ----
panel_6 = Panel("""nx
ny
nxy
mx
my
mxy
vx
vy""")
graft_3 = GraftTree(Tree=panel_6, IncludeEmptyLists=True, IncludeNullItems=True)

# ---- group: Vector Field 1 - Selection
list = ValueList({"n_1": 0, "n_2": 1, "m_1": 2, "m_2": 3, "ps_1_top": 4, "ps_1_bot": 5, "ps_1_mid": 6, "ps_2_top": 7, "ps_2_bot": 8, "ps_2_mid": 9, "custom_1": 10, "custom_2": 11}, selected="ps_1_mid")
int = Integer(list)

# ---- group: As 1 - Density Selection
list_2 = ValueList({"asx_": 0, "asy_": 1}, selected="asx_")
int_2 = Integer(list_2)

# ---- group: As 2 - Density Selection
list_3 = ValueList({"asx_": 0, "asy_": 1}, selected="asy_")
int_3 = Integer(list_3)

# ---- group: Display Vector Field - Selection
list_4 = ValueList({"n_1": 0, "n_2": 1, "m_1": 2, "m_2": 3, "ps_1_top": 4, "ps_1_bot": 5, "ps_1_mid": 6, "ps_2_top": 7, "ps_2_bot": 8, "ps_2_mid": 9, "custom_1": 10, "custom_2": 11}, selected="ps_1_mid")
int_4 = Integer(list_4)

# ---- group: Display Vector Field - Selection 2
list_5 = ValueList({"n_1": 0, "n_2": 1, "m_1": 2, "m_2": 3, "ps_1_top": 4, "ps_1_bot": 5, "ps_1_mid": 6, "ps_2_top": 7, "ps_2_bot": 8, "ps_2_mid": 9, "custom_1": 10, "custom_2": 11}, selected="ps_2_mid")
int_5 = Integer(list_5)

# ---- group: Display Mesh - Mode Selection
list_6 = ValueList({"max": 0, "min": 1, "avg": 2, "angle_avg": 3}, selected="avg")
int_6 = Integer(list_6)

# ----
panel_7 = Panel("""max
min
avg
angle_avg""")
int_7 = Integer(int_6)

# ---- group: RC - Design Controls
shell_thickness_m = Slider(0.1, range=0..1)
concrete_compression_strength_fck = Slider(40, range=0..100)
concrete_tension_strength_factor_fctd = Slider(10, range=0..100)
rebar_yield_strength_fy = Slider(500, range=0..1000)
cover_to_rebar_m = Slider(0.05, range=0..1)

# ---- group: Display Controls
display_results_on_mesh = BooleanToggle(True)
bool = Boolean(display_results_on_mesh)

display_vector_field = BooleanToggle(True)
bool_2 = Boolean(display_vector_field)

display_seeds = BooleanToggle(False)
bool_3 = Boolean(display_seeds)

display_face_singularities = BooleanToggle(True)
bool_4 = Boolean(display_face_singularities)

display_face_edge_planes = BooleanToggle(False)
bool_5 = Boolean(display_face_edge_planes)

# ----
min_length = Slider(0.2, range=0..2)
dl = Slider(0.01, range=0..0.1)
num_14 = Number(dl)
num_15 = Number(min_length)

dir_1_weight_vector_field = Slider(1, range=0..1)
dir_1_weight_separate = Slider(0, range=0..1)
dir_1_weight_align = Slider(0, range=0..1)
dir_2_weight_separate = Slider(0, range=0..1)
dir_2_weight_vector_field = Slider(1, range=0..1)
dir_2_weight_align = Slider(0, range=0..1)
merge = Merge(
    Data1=dir_1_weight_vector_field,
    Data2=dir_1_weight_separate,
    Data3=dir_1_weight_align,
    Data4=dir_2_weight_vector_field,
    Data5=dir_2_weight_separate,
    Data6=dir_2_weight_align)
num_16 = Number(merge)

# ---- group: Loading - Controls
area_load_kn_m2 = Slider(10, range=0..100)
num_17 = Number(area_load_kn_m2)

# ----
num_18 = Number(num_17)
panel_8 = Panel(num_18)
Z_2 = UnitZ(Factor=panel_8)
rev = Reverse(Vector=Z_2)
loads_3 = LoadsKaramba(Vector=rev, Mesh=mesh_8, LCase=0, mode="MeshLoad -Const.", menu=[buttons(off, on, off), buttons(on, on)])
entwine_2 = Entwine(Branch00=loads_3, FlattenInputs=True)
load = LoadKaramba(flatten(entwine_2))
load_2 = LoadKaramba(load)
assemble_2 = AssembleModelKaramba(Elem=element_2, Support=support_2, Load=load_2, LimitDistance_m=0.005)  # -> Model, Info, Mass_kg, CenterOfGravity
analyzethi = AnalyzeThIKaramba(Model=assemble_2.Model)  # -> CalculatedModel, MaximumDisplacement_m, ResultingForceOfGravity_kN, ElasticEnergy_kNm
model_4 = ModelKaramba(analyzethi.CalculatedModel)
panel_9 = Panel(analyzethi.MaximumDisplacement_m)

# ---- group: Algorithm - Controls
run_rc_design = BooleanToggle(True)
bool_6 = Boolean(run_rc_design)

# ----
vector_scale_2 = Slider(0.5, range=0..2.5)
num_19 = Number(vector_scale_2)

# ---- group: Algorithm - Controls
run_smesh = BooleanToggle(True)
bool_7 = Boolean(run_smesh)

# ---- group: Custom Vector - Controls
x_vector = Slider(1, range=0..1)
y_vector = Slider(0, range=0..1)
z_vector = Slider(0, range=0..1)
vec_2 = VectorXYZ(XComponent=x_vector, YComponent=y_vector, ZComponent=z_vector)  # -> Vector, Length
vec_3 = Vector(vec_2.Vector)

# ----
vec_4 = Vector(vec_3)

vector_scale = Slider(0.5, range=0..2.5)
num_20 = Number(vector_scale)

singularities_tol = Slider(0.001, range=0..1)
num_21 = Number(singularities_tol)

panel_10 = Panel("""n_1
n_2
m_1
m_2
ps_1_top
ps_1_bot
ps_1_mid
ps_2_top
ps_2_bot
ps_2_mid
custom_1
custom_2""")
int_8 = Integer(int)
int_9 = Integer(int_4)
graft_4 = GraftTree(Tree=panel_10, IncludeEmptyLists=True, IncludeNullItems=True)
item_5 = ListItem(List=panel_10, Index=int_9, Wrap=True)
item_6 = ListItem(List=panel_10, Index=int_8, Wrap=True)

panel_11 = Panel("""asx_
asy_""")
int_10 = Integer(int_2)
int_11 = Integer(int_3)
item_7 = ListItem(List=panel_11, Index=int_10, Wrap=True)
item_8 = ListItem(List=panel_11, Index=int_11, Wrap=True)

int_12 = Integer(int_5)
item_9 = ListItem(List=panel_10, Index=int_12, Wrap=True)
item_10 = ListItem(List=panel_7, Index=int_7, Wrap=True)

# ---- group: Internal Forces - Tags
txt = Text(graft_3)

# ---- group: as_tag_1
txt_2 = Text(item_7)

# ---- group: as_tag_2
txt_3 = Text(item_8)

# ---- group: Principal Vectors - Tags
txt_4 = Text(graft_4)

# ---- group: vector_tag
txt_5 = Text(item_6)

# ---- group: vector_tag - display
txt_6 = Text(item_5)

# ---- group: Display - Tag
txt_7 = Text(item_10)

# ----
txt_8 = Text(item_9)

# ---- group: RC - Design Controls
num_22 = Number(shell_thickness_m)
num_23 = Number(cover_to_rebar_m)
num_24 = Number(concrete_compression_strength_fck)
num_25 = Number(concrete_tension_strength_factor_fctd)
num_26 = Number(rebar_yield_strength_fy)

# ----
crv_4 = Curve()
crv_5 = Curve()

bool_8 = Boolean(bool_3)

X = UnitX(Factor="6")
swatch_3 = ColourSwatch(SwatchColor=RGB(0, 0, 0))
swatch_4 = ColourSwatch(SwatchColor=RGB(0, 0, 0))
swatch_5 = ColourSwatch(SwatchColor=RGB(3, 3, 3))
Z_3 = UnitZ(Factor="6")
Z_4 = UnitZ(Factor="6")
panel_12 = Panel("4 to 0.5")
panel_13 = Panel("2")
swatch_6 = ColourSwatch(SwatchColor=RGB(0, 0, 0))

# ---- group: Principal Vectors - Tags
txt_9 = Text(txt_4)

# ----
panel_15 = Panel("0")

# ---- group: vector_tag
txt_10 = Text(txt_5)

# ---- group: Optional Colors
range_4 = Range(Domain=Domain(0, 1), Steps=10)
gradient_3 = Gradient(
    LowerLimit=0,
    UpperLimit=1,
    Parameter=range_4,
    stops=[0: RGB(255, 0, 0), 0.176: RGB(255, 238, 0), 0.35: RGB(0, 255, 234), 0.504: RGB(35, 4, 128), 0.664: RGB(0, 252, 215), 0.843: RGB(255, 255, 0), 1: RGB(255, 0, 47)])

# ----
panel_16 = Panel("""1
-1
0""")

# ---- group: Principal Vectors - Tags
txt_11 = Text(flatten(txt_4))

# ----
txt_12 = Text(flatten(txt))
bool_9 = Boolean(bool_6)
num_27 = Number(num_22)
num_28 = Number(num_23)
num_29 = Number(num_24)
num_30 = Number(num_26)
num_31 = Number(num_25)
panel_17 = Panel("True")

# ---- group: display
bool_10 = Boolean(bool)

# ---- group: mode
txt_13 = Text(txt_7)

# ---- group: vector_tag
txt_14 = Text(txt_8)

txt_15 = Text(txt_6)

# ---- group: Vector Scale
num_32 = Number(num_21)

# ---- group: vector_tag
txt_16 = Text(txt_6)

# ---- group: display
bool_11 = Boolean(bool_4)

bool_12 = Boolean(bool_5)

# ---- group: Vector Scale
num_33 = Number(num_20)

num_34 = Number(num_19)

# ---- group: display
bool_13 = Boolean(bool_2)

bool_14 = Boolean(bool_2)

# ----
proximity_at_start = Slider(0.8, range=0..1)
number_of_samples = Slider(20, range=0..500)
strat_factor = Slider(1, range=0..1)
proximity_factor_to_others = Slider(0.05, range=0..1)
proximity_to_itself = Slider(2, range=0..10)
iterations = Slider(2000, range=0..10000)
int_13 = Integer(number_of_samples)
num_35 = Number(strat_factor)
num_36 = Number(proximity_factor_to_others)
num_37 = Number(iterations)
num_38 = Number(proximity_at_start)
num_39 = Number(proximity_to_itself)

run_streamlines_jobard = BooleanToggle(True)
bool_15 = Boolean(run_streamlines_jobard)

uniform_spacing = BooleanToggle(True)
min_sp_m = Slider(1, range=0..1)
dl_2 = Slider(0.1, range=0..0.1)
min_length_2 = Slider(0.1, range=0..4)
num_40 = Number(dl_2)
num_41 = Number(min_length_2)
bool_16 = Boolean(uniform_spacing)
num_42 = Number(min_sp_m)

run_streamlines_jobard_2 = BooleanToggle(True)
bool_17 = Boolean(run_streamlines_jobard_2)

uniform_spacing_2 = BooleanToggle(True)
min_sp_m_2 = Slider(1, range=0..1)
dl_3 = Slider(0.1, range=0..0.1)
min_length_3 = Slider(0.2, range=0..4)
num_43 = Number(min_sp_m_2)
bool_18 = Boolean(uniform_spacing_2)
num_44 = Number(min_length_3)
num_45 = Number(dl_3)

number_of_samples_2 = Slider(20, range=0..300)
proximity_at_start_2 = Slider(0.9, range=0..1)
strat_factor_2 = Slider(1, range=0..1)
proximity_factor_to_others_2 = Slider(0.05, range=0..1)
proximity_to_itself_2 = Slider(2, range=0..10)
iterations_2 = Slider(2000, range=0..10000)
int_14 = Integer(number_of_samples_2)
num_46 = Number(strat_factor_2)
num_47 = Number(proximity_factor_to_others_2)
num_48 = Number(proximity_at_start_2)
num_49 = Number(proximity_to_itself_2)
num_50 = Number(iterations_2)

# ---- group: Display Mesh - Results Selection
list_7 = ValueList({"nx": 0, "ny": 1, "nxy": 2, "mx": 3, "my": 4, "mxy": 5, "vx": 6, "vy": 7, "asx_b": 8, "asx_t": 9, "asy_b": 10, "asy_t": 11, "asx_c": 12, "asy_c": 13, "asx_": 14, "asy_": 15, "sp_asx_": 16, "sp_asy_": 17}, selected="sp_asy_")
int_15 = Integer(list_7)

# ----
panel_19 = Panel("""asx_b
asx_t
asy_b
asy_t
asx_c
asy_c
asx_
asy_
spacing_asx_
spacing_asy_""")
int_16 = Integer(int_15)

merge_2 = Merge(Data1=panel_6, Data2=panel_19)
item_11 = ListItem(List=merge_2, Index=int_16, Wrap=True)

# ---- group: Display - Tag
txt_17 = Text(item_11)

# ---- group: data_tag
txt_18 = Text(txt_17)

# ----
percentage_of_max_demand_dir_1 = Slider(0.67, range=0..1)
percentage_of_max_demand_dir_2 = Slider(0.67, range=0..1)
bar_diameter_mm_dir_1 = Slider(6, range=0..30)
bar_diameter_mm_dir_2 = Slider(6, range=0..30)
max_spacing_dir_2 = Slider(0.4, range=0..1)
max_spacing_dir_1 = Slider(0.4, range=0..1)
merge_3 = Merge(Data1=bar_diameter_mm_dir_1, Data2=bar_diameter_mm_dir_2)
merge_4 = Merge(Data1=max_spacing_dir_1, Data2=max_spacing_dir_2)
merge_5 = Merge(Data1=percentage_of_max_demand_dir_1, Data2=percentage_of_max_demand_dir_2)
num_51 = Number(merge_4)
num_52 = Number(merge_5)
num_53 = Number(merge_3)

# ---- group: bar diameter
num_54 = Number(num_53)

# ---- group: max spacing
num_55 = Number(num_51)

# ---- group: % demand
num_56 = Number(num_52)

# ----
pt_17 = ConstructPoint(XCoordinate=0, YCoordinate=0, ZCoordinate=0)
pt_18 = Point(pt_17)
pt_19 = Point(pt_18)
bool_19 = Boolean(bool_15)
txt_19 = Text(txt_2)
num_57 = Number(num_16)
num_58 = Number(num_40)
num_59 = Number(num_41)
txt_20 = Text(txt_5)
num_60 = Number(num_42)
bool_20 = Boolean(bool_16)
int_17 = Integer(int_13)
num_61 = Number(num_35)
num_62 = Number(num_36)
num_63 = Number(num_38)
num_64 = Number(num_39)
num_65 = Number(num_37)
num_66 = Number(num_44)
num_67 = Number(num_16)
num_68 = Number(num_48)
bool_21 = Boolean(bool_17)
num_69 = Number(num_45)
txt_21 = Text(txt_5)
txt_22 = Text(txt_3)
num_70 = Number(num_43)
bool_22 = Boolean(bool_18)
int_18 = Integer(int_14)
num_71 = Number(num_46)
num_72 = Number(num_47)
num_73 = Number(num_49)
num_74 = Number(num_50)
pt_20 = Point(pt_18)
panel_20 = Panel("3")

panel_21 = Panel("""dir1-8-8
dir2-8-8
boundary""")
panel_22 = Panel("""dir1-12-12
dir2-12-12
boundary""")
panel_23 = Panel("""dir1-6-6
dir2-6-6
boundary""")
panel_24 = Panel("""dir1-10-10
dir2-10-10
boundary""")
dpipeline = DynamicGeometryPipeline(
    LayerFilter=panel_22,
    TypeFilter="curve",
    NameFilter="*",
    GroupByLayer=False,
    GroupByType=False,
    IncludeHidden=True,
    IncludeLocked=True,
    enableFullPath=False,
    listenToAttributes=True)
crv_6 = Curve(dpipeline)

pt_21 = ConstructPoint(XCoordinate="0", YCoordinate=0, ZCoordinate=0)
xz = XZPlane(Origin=pt_21)
bool_23 = Boolean("False")
crv_7 = Curve([<curve referenced from the Rhino model> x959])
line_3 = Line(crv_7)
int_19 = Integer(Slider(8, range=0..100))
X_2 = UnitX(Factor="0")
Z_5 = UnitZ(Factor=1)
rev_2 = Reverse(Vector=Z_5)
panel_25 = Panel("0")
X_3 = UnitX(Factor=panel_25)
swatch_7 = ColourSwatch(SwatchColor=RGB(0, 0, 0))

# ----
# principle forces
shellvecresults_2 = ResultVectorsOnShellsKaramba3D(AnalyzedModel=analyze.CalculatedModel, mode="PrincForce")  # -> AnalyzedModel, Points, FirstPrincipalNormalForceVector_kN_m, SecondPrincipalNormalForceVector_kN_m, FirstPrincipalMomentVector_kN, SecondPrincipalMomentVector_kN, FirstPrincipalNormalForceValue_kN_m, SecondPrincipalNormalForceValue_kN_m, FirstPrincipalMomentValue_kN, SecondPrincipalMomentValue_kN; disabled
number_slider_3 = Slider(0.035, range=0..1)  # disabled
swatch_8 = ColourSwatch(SwatchColor=RGB(255, 0, 0))  # disabled
swatch_9 = ColourSwatch(SwatchColor=RGB(0, 0, 255))  # disabled

multiplication_5 = Multiplication(A=number_slider_3, B=shellvecresults_2.SecondPrincipalNormalForceValue_kN_m)  # disabled
multiplication_6 = Multiplication(A=number_slider_3, B=shellvecresults_2.FirstPrincipalNormalForceValue_kN_m)  # disabled

amp_3 = Amplitude(Vector=shellvecresults_2.FirstPrincipalNormalForceVector_kN_m, Amplitude=multiplication_6)  # disabled
amp_4 = Amplitude(Vector=shellvecresults_2.SecondPrincipalNormalForceVector_kN_m, Amplitude=multiplication_5)  # disabled
vdisex_4 = VectorDisplayEx(Point=shellvecresults_2.Points, Vector=amp_3, Colour=swatch_8, Width=2)  # disabled
vdisex_5 = VectorDisplayEx(Point=shellvecresults_2.Points, Vector=amp_4, Colour=swatch_9, Width=2)  # disabled

# ----
# principle forces
shellvecresults_3 = ResultVectorsOnShellsKaramba3D(AnalyzedModel=analyze.CalculatedModel, mode="PrincForce")  # -> AnalyzedModel, Points, FirstPrincipalNormalForceVector_kN_m, SecondPrincipalNormalForceVector_kN_m, FirstPrincipalMomentVector_kN, SecondPrincipalMomentVector_kN, FirstPrincipalNormalForceValue_kN_m, SecondPrincipalNormalForceValue_kN_m, FirstPrincipalMomentValue_kN, SecondPrincipalMomentValue_kN; disabled
number_slider_4 = Slider(0.035, range=0..1)  # disabled
swatch_10 = ColourSwatch(SwatchColor=RGB(0, 0, 255))  # disabled
swatch_11 = ColourSwatch(SwatchColor=RGB(255, 0, 0))  # disabled

multiplication_7 = Multiplication(A=number_slider_4, B=shellvecresults_3.SecondPrincipalNormalForceValue_kN_m)  # disabled
multiplication_8 = Multiplication(A=number_slider_4, B=shellvecresults_3.FirstPrincipalNormalForceValue_kN_m)  # disabled

amp_5 = Amplitude(Vector=shellvecresults_3.FirstPrincipalNormalForceVector_kN_m, Amplitude=multiplication_8)  # disabled
amp_6 = Amplitude(Vector=shellvecresults_3.SecondPrincipalNormalForceVector_kN_m, Amplitude=multiplication_7)  # disabled
vdisex_6 = VectorDisplayEx(Point=shellvecresults_3.Points, Vector=amp_5, Colour=swatch_11, Width=2)  # disabled
vdisex_7 = VectorDisplayEx(Point=shellvecresults_3.Points, Vector=amp_6, Colour=swatch_10, Width=2)  # disabled

panel_26 = Panel("""1
-1
0""")
graft_5 = GraftTree(Tree=panel_26, IncludeEmptyLists=True, IncludeNullItems=True)
shellvecresults_4 = ResultVectorsOnShellsKaramba(AnalyzedModel=model_2, mode="PrincForce")  # -> AnalyzedModel, Points, FirstPrincipalNormalForceVector_kN_m, SecondPrincipalNormalForceVector_kN_m, FirstPrincipalMomentVector_kN, SecondPrincipalMomentVector_kN, FirstPrincipalNormalForceValue_kN_m, SecondPrincipalNormalForceValue_kN_m, FirstPrincipalMomentValue_kN, SecondPrincipalMomentValue_kN
shellvecresults_5 = ResultVectorsOnShellsKaramba(AnalyzedModel=model_2, LayerOfResults=graft_5, mode="PrincStress")  # -> AnalyzedModel, Points, FirstPrincipalStressVector_kN_cm2, SecondPrincipalStressVector_kN_cm2, FirstPrincipalStressValue_kN_cm2, SecondPrincipalStressValue_kN_cm2
disassemble = DisassembleModelKaramba(Model=model_2)  # -> Model, Point, Beam, Shell, Support, Load, Line, Mesh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

vec_5 = Vector(shellvecresults_5.SecondPrincipalStressVector_kN_cm2)
vec_6 = Vector(shellvecresults_5.FirstPrincipalStressVector_kN_cm2)

vec_7 = Vector(shellvecresults_4.SecondPrincipalNormalForceVector_kN_m)
vec_8 = Vector(shellvecresults_4.FirstPrincipalNormalForceVector_kN_m)

vec_9 = Vector(shellvecresults_4.FirstPrincipalMomentVector_kN)
vec_10 = Vector(shellvecresults_4.SecondPrincipalMomentVector_kN)

vec_11 = Vector(simplify(vec_6))
vec_12 = Vector(simplify(vec_5))
vec_13 = Vector(vec_7)
vec_14 = Vector(vec_8)
vec_15 = Vector(vec_9)
vec_16 = Vector(vec_10)

path_mapper = PathMapper(vec_12, source="{A}", target="{A+7}")
path_mapper_2 = PathMapper(vec_11, source="{A}", target="{A+4}")
entwine_3 = Entwine(Branch00=vec_14, Branch01=vec_13, Branch02=vec_15, Branch03=vec_16, FlattenInputs=True)  # -> simplify(Result)
merge_6 = Merge(Data1=entwine_3, Data2=simplify(path_mapper_2), Data3=simplify(path_mapper))

mesh_9 = Mesh(disassemble.Mesh)

# ---- group: Vector Fields
vec_17 = Vector(merge_6)

# ----
vec_18 = Vector(vec_17)
mesh_10 = Mesh(mesh_9)

cluster = Cluster(mesh=mesh_10, vec=vec_4)  # -> vec_6, vec_5
entwine_4 = Entwine(Branch00=cluster.vec_6, Branch01=cluster.vec_5, FlattenInputs=True)  # -> simplify(Result)
path_mapper_3 = PathMapper(entwine_4, source="{A}", target="{A+10}")
merge_7 = Merge(Data1=vec_18, Data2=simplify(path_mapper_3))

mesh_11 = Mesh(mesh_10)
model_5 = ModelKaramba(model)
vec_19 = Vector(merge_7)

mesh_12 = Mesh(mesh_11)
vec_20 = Vector(vec_19)
model_6 = ModelKaramba(model_5)

vec_21 = Vector(vec_20)
mesh_13 = Mesh(mesh_12)
project_2 = Project(Geometry=mesh_13, Plane=PlaneXY(0, 0, 0))  # -> Geometry, Transform
branch = TreeBranch(Tree=vec_21, Path=Slider(3, range=0..100), MaintainPaths=True)
facen = FaceNormals(Mesh=mesh_13)  # -> Centers, Normals
faceb = FaceBoundaries(Mesh=mesh_13)
faceb_2 = FaceBoundaries(Mesh=project_2.Geometry)
tstat = TreeStatistics(Tree=vec_21)  # -> Paths, Length, Count
graft_6 = GraftTree(Tree=faceb_2, IncludeEmptyLists=True, IncludeNullItems=True)  # -> simplify(Tree)
rev_3 = Reverse(Vector=branch)
line_4 = LineSDL(Start=facen.Centers, Direction=vec_21, Length="0.10")  # -> simplify(Line)
dup = DuplicateData(Data=graft_6, Number=tstat.Count, Order=True)
clx = CurveLine(Curve=reparameterize(faceb), Line=line_4)  # -> Points, simplify(Params), Count
graft_7 = GraftTree(Tree=dup, IncludeEmptyLists=True, IncludeNullItems=True)  # -> simplify(Tree)
path_mapper_4 = PathMapper(graft_7, source="{A;B}", target="{B;A}")
data = Data(path_mapper_4)
eval_2 = EvaluateCurve(Curve=reparameterize(simplify(data)), Parameter=clx.Params)  # -> Point, Tangent, Angle; disabled
eval_3 = EvaluateCurve(Curve=reparameterize(graft(data)), Parameter=clx.Params)  # -> Point, Tangent, Angle
pline = PolyLine(Vertices=eval_2.Point, Closed=False)
pline_2 = PolyLine(Vertices=eval_3.Point, Closed=False)
mesh_14 = Mesh(project_2.Geometry)
crv_8 = Curve(pline)
crv_9 = Curve(pline_2)
crv_10 = Curve(crv_9)
end_2 = EndPoints(Curve=crv_10)  # -> Start, End
vec2pt_2 = Vector2Pt(PointA=end_2.Start, PointB=end_2.End, Unitize=False)  # -> Vector, Length
trim = TrimTree(Tree=simplify(vec2pt_2.Vector), Depth=1)
vec_22 = Vector(trim)

vec_23 = Vector(vec_22)
mesh_15 = Mesh(mesh_14)
model_7 = ModelKaramba(model_6)

wbnaked = WeaverbirdsNakedBoundary(MeshClosedPolylines=mesh_15)

mesh_16 = Mesh(mesh_15)
bool_24 = Boolean(bool_7)

# ---- group: Principal Vectors
vec_24 = Vector(vec_23)

# ----
wbedges_3 = WeaverbirdsMeshEdges(MeshOrPolylines=mesh_16)
python = GhPythonScript(run=bool_24, mesh=mesh_16, vectors=vec_24, vectors_tags=txt_9)  # -> out, s_mesh; inputs mesh: Mesh, vectors: tree of Vector3d, vectors_tags: tree
# ---------- python: Python ----------
__author__ = "Rafael Pastrana"
__name__ = "Mesh Maker"
__date__ = "2018.07.19"
__version__ = "0.0.1"


# 1. Import dependencies
import sys
import imp
import rhinoscriptsyntax as rs

# 1-b. Replace with your own path here
# sys.path.append("Z:\projects\streamlines\src\streamlines")

# import custom_mesh
# imp.reload(custom_mesh)

# from custom_mesh import StructuralMesh
from streamlines.custom_mesh import StructuralMesh

# Define Global Variables
NORM = False

# 2. Start System
if run is True:
    print('SYSTEM STARTED')
        
    # instantiate mesh
    my_mesh = StructuralMesh(mesh)

    # set vector attributes
    for idx, vector_field in enumerate(vectors.Branches):
        tag = vectors_tags.Branches[idx][0]
        clean_vectors = [[vec.X, vec.Y, vec.Z] for vec in vector_field]
        my_mesh.set_face_vectors(clean_vectors, tag, NORM)
        # my_mesh.set_vertex_vectors(tag)
        my_mesh.set_vertex_vectors_angles(tag)
    
    # output mesh
    s_mesh = my_mesh
# ---------- end python ----------
lng = ListLength(List=wbedges_3)
panel_27 = Panel(lng)
data_2 = Data(python.s_mesh)

# ---- group: s_mesh
data_3 = Data(data_2)

# ----
python_2 = GhPythonScript(s_mesh=data_3, vector_tag=txt_10)  # -> out, s_mesh, vector_field
# ---------- python_2: Python ----------
# 1. Import dependencies
import rhinoscriptsyntax as rs
import copy

print('number of edges is: {}'.format(len([e for e in s_mesh.c_mesh.edges()])))

# 2. Start System
my_mesh = s_mesh
v_name = vector_tag

# vector properties
vector_field = [x[0] for x in my_mesh.find_vector_face_centers(v_name)]
vector_field = [rs.CreateVector(x) for x in vector_field]
s_mesh = my_mesh
# ---------- end python_2 ----------
panel_28 = Panel(python.out)
vec_25 = Vector(python_2.vector_field)
model_8 = ModelKaramba(model_7)
vec_26 = Vector(vec_25)

disassemble_2 = DisassembleModelKaramba(Model=model_8)  # -> Model, Point, Beam, Shell, Support, Load, Line, Mesh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
orientate_2 = OrientateElemKaramba(Shell=disassemble_2.Shell, XOrientations=unitize(vec_26), mode="Shell")
assemble_3 = AssembleModelKaramba(
    Points=disassemble_2.Point,
    Elem=orientate_2,
    Support=disassemble_2.Support,
    Load=disassemble_2.Load,
    LimitDistance_m=0.005)  # -> Model, Info, Mass_kg, CenterOfGravity
analyzethi_2 = AnalyzeThIKaramba(Model=assemble_3.Model)  # -> CalculatedModel, MaximumDisplacement_m, ResultingForceOfGravity_kN, ElasticEnergy_kNm

model_9 = ModelKaramba(analyzethi_2.CalculatedModel)

model_10 = ModelKaramba(model_9)
modelview_2 = ModelViewKaramba(Model=model_10, LoadCaseFactorsForLinearSuperposition=1, IndexOfVisibleLoadcase=-1)  # -> Model, DeformedMesh, DeformedAxes, DeformedModel
shellview_3 = ShellViewKaramba(Model=modelview_2.Model, IndexOfLayer=0)  # -> Model, MeshesOfRenderedShells, LegendColors, LegendTags
legend_2 = Legend(Colour=shellview_3.LegendColors, Tags=shellview_3.LegendTags, LegendType=1)

model_11 = ModelKaramba(model_9)
modelview_3 = ModelViewKaramba(
    Model=model_11,
    LoadCaseFactorsForLinearSuperposition=1,
    IndexOfVisibleLoadcase=-1,
    ListOfColorsForColoringPlots=gradient_3)  # -> Model, DeformedMesh, DeformedAxes, DeformedModel
shellview_4 = ShellViewKaramba(Model=modelview_3.Model, IndexOfLayer=0)  # -> Model, MeshesOfRenderedShells, LegendColors, LegendTags
legend_3 = Legend(Colour=shellview_4.LegendColors, Tags=shellview_4.LegendTags, LegendType=1)

panel_29 = Panel(analyzethi_2.MaximumDisplacement_m)
model_12 = ModelKaramba(model_9)

graft_8 = GraftTree(Tree=panel_16, IncludeEmptyLists=True, IncludeNullItems=True)
shellvecresults_6 = ResultVectorsOnShellsKaramba(AnalyzedModel=model_12, LayerOfResults=graft_8, mode="PrincStress")  # -> AnalyzedModel, Points, FirstPrincipalStressVector_kN_cm2, SecondPrincipalStressVector_kN_cm2, simplify(FirstPrincipalStressValue_kN_cm2), simplify(SecondPrincipalStressValue_kN_cm2)
shellvecresults_7 = ResultVectorsOnShellsKaramba(AnalyzedModel=model_12, mode="PrincForce")  # -> AnalyzedModel, Points, FirstPrincipalNormalForceVector_kN_m, SecondPrincipalNormalForceVector_kN_m, FirstPrincipalMomentVector_kN, SecondPrincipalMomentVector_kN, FirstPrincipalNormalForceValue_kN_m, SecondPrincipalNormalForceValue_kN_m, FirstPrincipalMomentValue_kN, SecondPrincipalMomentValue_kN
path_mapper_5 = PathMapper(shellvecresults_6.SecondPrincipalStressValue_kN_cm2, source="{A}", target="{A+7}")
path_mapper_6 = PathMapper(shellvecresults_6.FirstPrincipalStressValue_kN_cm2, source="{A}", target="{A+4}")
entwine_5 = Entwine(
    Branch00=shellvecresults_7.FirstPrincipalNormalForceValue_kN_m,
    Branch01=shellvecresults_7.SecondPrincipalNormalForceValue_kN_m,
    Branch02=shellvecresults_7.FirstPrincipalMomentValue_kN,
    Branch03=shellvecresults_7.SecondPrincipalMomentValue_kN,
    FlattenInputs=True)  # -> simplify(Result)
merge_8 = Merge(Data1=entwine_5, Data2=simplify(path_mapper_6), Data3=simplify(path_mapper_5))

s_forces_2 = ShellForcesKaramba(AnalyzedModel=model_12, LCase=0, mode="Local")  # -> AnalyzedModel, Nxx_kN_m, Nyy_kN_m, Nxy_kN_m, Mxx_kN, Myy_kN, Mxy_kN, Vx_kN_m, Vy_kN_m
graft_9 = GraftTree(Tree=s_forces_2.Nxx_kN_m, IncludeEmptyLists=True, IncludeNullItems=True)  # -> simplify(Tree)
graft_10 = GraftTree(Tree=s_forces_2.Nyy_kN_m, IncludeEmptyLists=True, IncludeNullItems=True)  # -> simplify(Tree)
graft_11 = GraftTree(Tree=s_forces_2.Nxy_kN_m, IncludeEmptyLists=True, IncludeNullItems=True)  # -> simplify(Tree)
graft_12 = GraftTree(Tree=s_forces_2.Mxx_kN, IncludeEmptyLists=True, IncludeNullItems=True)  # -> simplify(Tree)
graft_13 = GraftTree(Tree=s_forces_2.Myy_kN, IncludeEmptyLists=True, IncludeNullItems=True)  # -> simplify(Tree)
graft_14 = GraftTree(Tree=s_forces_2.Mxy_kN, IncludeEmptyLists=True, IncludeNullItems=True)  # -> simplify(Tree)
graft_15 = GraftTree(Tree=s_forces_2.Vx_kN_m, IncludeEmptyLists=True, IncludeNullItems=True)  # -> simplify(Tree)
graft_16 = GraftTree(Tree=s_forces_2.Vy_kN_m, IncludeEmptyLists=True, IncludeNullItems=True)  # -> simplify(Tree)
merge_9 = Merge(
    Data1=graft_9,
    Data2=graft_10,
    Data3=graft_11,
    Data4=graft_12,
    Data5=graft_13,
    Data6=graft_14,
    Data7=graft_15,
    Data8=graft_16)
flip = FlipMatrix(Data=merge_9)

num_75 = Number(merge_8)
num_76 = Number(flip)

txt_23 = Text(flatten(txt))
data_4 = Data(data_2)

num_77 = Number(num_76)

# ---- group: Assign Local Internal Forces to sMesh
python_3 = GhPythonScript(s_mesh=data_4, int_forces=num_77, force_tags=txt_23)  # -> out, s_mesh; inputs int_forces: tree, force_tags: list
# ---------- python_3: Python ----------
__author__ = "Rafael Pastrana"
__name__ = "Mesh Maker"
__date__ = "2018.07.19"
__version__ = "0.0.1"


# 1. Import dependencies
import rhinoscriptsyntax as rs
import copy

# 2. Start System
# set vector attributes
my_mesh = s_mesh


for idx, int_force in enumerate(int_forces.Branches):
    tag = force_tags[idx]
    
    for f_key in my_mesh.c_mesh.faces():
        force = int_force[f_key]
        if force == 0:
            force = 1e-7
            
        my_mesh.c_mesh.set_face_attribute(f_key, str(tag), force)

s_mesh = my_mesh
# ---------- end python_3 ----------

# ----
data_5 = Data(python_3.s_mesh)
data_6 = Data(data_5)
num_78 = Number(num_75)

# ---- group: Assign Principal Internal Forces to sMesh
python_4 = GhPythonScript(s_mesh=data_6, int_forces=num_78, force_tags=txt_11)  # -> out, s_mesh; inputs int_forces: tree, force_tags: list
# ---------- python_4: Python ----------
__author__ = "Rafael Pastrana"
__name__ = "Mesh Maker"
__date__ = "2018.07.19"
__version__ = "0.0.1"


# 1. Import dependencies
import rhinoscriptsyntax as rs
import copy

TAG = '_val'
my_mesh = s_mesh

# 2. Start System
# set vector attributes
for idx, int_force in enumerate(int_forces.Branches):
    f_tag = force_tags[idx] + TAG
    
    for f_key in my_mesh.c_mesh.faces():
        force = int_force[f_key]
        if force == 0:
            force = 1e-7
        my_mesh.c_mesh.set_face_attribute(f_key, str(f_tag), force)

s_mesh = my_mesh
# ---------- end python_4 ----------

# ----
data_7 = Data(python_4.s_mesh)
data_8 = Data(data_7)
mesh_17 = Mesh(mesh_14)
wbnaked_2 = WeaverbirdsNakedBoundary(MeshClosedPolylines=mesh_17)
crv_11 = Curve(wbnaked_2)
crv_12 = Curve(crv_11)
explode_2 = Explode(Curve=crv_12, Recursive=True)  # -> Segments, Vertices

line_5 = Line(line_3)
mesh_18 = Mesh(mesh_12)

line_topo = LineTopology(ListOfLines=line_5, Tolerance=0.001)  # -> ListOfPoints, LinePointStructure, PointPointStructure, PointLineStructure
meshcp = MeshClosestPoint(Point=line_topo.ListOfPoints, Mesh=mesh_18)  # -> Point, Index, Parameter
facen_2 = FaceNormals(Mesh=mesh_18)  # -> Centers, Normals
item_12 = ListItem(List=facen_2.Normals, Index=meshcp.Index, Wrap=True)
unit = UnitVector(Vector=item_12)
multiplication_9 = Multiplication(A=unit, B="0.1")
pl = PlaneNormal(Origin=meshcp.Point, ZAxis=unit)
vdisex_8 = VectorDisplayEx(Point=meshcp.Point, Vector=multiplication_9, Colour=RGB(0, 0, 0), Width=2)

meval = MeshEval(Mesh=mesh_18, Parameter=meshcp.Parameter)  # -> Point, Normal, Colour

pt_22 = Point(line_topo.ListOfPoints)
int_20 = Integer(line_topo.PointPointStructure)
pln = Plane(pl)

pln_2 = Plane(pln)
int_21 = Integer(int_20)
pt_23 = Point(pt_22)

gcfl = GetCellsFromLines(Connectivity=int_21, Points=pt_23, Planes=pln_2)
lng_2 = ListLength(List=gcfl)
int_22 = Integer(gcfl)
pt_24 = Point(pt_23)
panel_30 = Panel(lng_2)
item_13 = ListItem(List=pt_24, Index=int_22, Wrap=True)
pt_25 = Point(pt_24)
int_23 = Integer(int_22)
pline_3 = PolyLine(Vertices=item_13, Closed=False)
python_5 = GhPythonScript(rs_points=pt_25, topology=int_23, factor=int_19)  # -> out, mesh_face_centroids, mesh_edges, mesh_vertices, mesh_face_vertices; inputs rs_points: list of Point3d, topology: tree of Int32
# ---------- python_5: Python ----------
__author__ = "ARPJ"
__version__ = "2018.07.25"

import rhinoscriptsyntax as rs
import compas.datastructures
import compas_rhino
import System
import clr
clr.AddReference("Grasshopper")
import Grasshopper.Kernel.Data.GH_Path as ghpath
import Grasshopper.DataTree as datatree
import Rhino.Geometry as rg
from compas.datastructures import Mesh
from compas.datastructures import Network

FACTOR = factor  # 5

def get_coordinates(points):
    return [(point.X, point.Y, point.Z) for point in points]

def get_line_coordinates(lines):
    line_coords = []
    for line in lines:
          line_coord = rs.CurveStartPoint(line), rs.CurveEndPoint(line)
          line_coords.append(get_coordinates(line_coord))
    return line_coords

def get_edges_lines(dstr, geo=True):
    edges = []
    for u, v in dstr.edges():
        start, end = dstr.edge_coordinates(u, v)
        if geo is True:
            edges.append(rs.AddLine(start, end))
        else:
            edges.append((start, end))
    return edges
    
def get_vertices_points(dstr, geo=True):
    points = []
    for v in dstr.vertices():
        if geo is True:
            points.append(rs.AddPoint(dstr.vertex_coordinates(v)))
        else:
            points.append(dstr.vertex_coordinates(v))
    return points

def get_faces_centroids(dstr):
    centroids = []
    for f_key in dstr.faces():
        pt = rs.AddPoint(*dstr.face_centroid(f_key))
        centroids.append(pt)
    return centroids

def get_vertices_faces(gh_mesh):
    vertices = [[v.X, v.Y, v.Z] for v in rs.MeshVertices(gh_mesh)]
    faces = [list(face) for face in rs.MeshFaceVertices(gh_mesh)]
    return vertices, faces
    
def get_face_rs_vertices(c_mesh):
    f_ver = datatree[System.Object]()
    
    for idx, f in enumerate(c_mesh.faces()):
        f_ver.AddRange([rg.Point3d(*c) for c in c_mesh.face_coordinates(f)], ghpath(idx))
    
    return f_ver
    
def get_faces_topology(topo):
    faces = []
    for cell in topo.Branches:
        new_cell =[value for value in cell]
        faces.append(new_cell)
    return faces

def sanitize_faces(mesh):
    ids = []
    h_e = [mesh.face_halfedges(f) for f in mesh.faces()]
    
    thres = sum(list(map(lambda x: len(x), h_e))) / len(h_e)
    thres = thres * FACTOR
    print('threshold is {}'.format(thres))
    for f in mesh.faces():
        if len(mesh.face_halfedges(f)) > thres:
            ids.append(f)
            
    if len(ids) > 0:
        for id in ids:
            mesh.delete_face(id)
        print('----')
        print('{} faces were sanitized'.format(len(ids)))
    return mesh
        
def sanitize_edges(mesh):
    ids = []
    for u, v in mesh.edges():
        num_f = list(mesh.edge_faces(u, v))
        
        if None in num_f:
            clean_num_f = [x for x in num_f if x is not None]
            if len(clean_num_f) > 1:
                com = [(f, len(mesh.face_vertices(f))) for f in clean_num_f]
                com = sorted(com, key=lambda x: x[1])
                ids.append(com[-1][0])
    
    if len(ids) > 0:
        for id in ids:
            mesh.delete_face(id)
        print('----')
        print('{} faces were sanitized'.format(len(ids)))
    return mesh

m_v = get_coordinates(rs_points)
m_f = get_faces_topology(topology)

# print(len(m_v))
# print(len(m_f))
# print(m_f[1])

c_mesh = Mesh.from_vertices_and_faces(m_v, m_f)
#c_mesh = sanitize_edges(c_mesh)
c_mesh = sanitize_faces(c_mesh)
#print(c_mesh)

# cull out redundant faces
# 1. faces that contain several faces

# display
mesh_face_centroids = get_faces_centroids(c_mesh)
mesh_edges = get_edges_lines(c_mesh)
mesh_vertices = get_vertices_points(c_mesh)
mesh_face_vertices = get_face_rs_vertices(c_mesh)
# ---------- end python_5 ----------
panel_31 = Panel(python_5.out)
pt_26 = Point(python_5.mesh_vertices)
pt_27 = Point(python_5.mesh_face_vertices)
pt_28 = Point(python_5.mesh_face_centroids)
line_6 = Line(python_5.mesh_edges)
pt_29 = Point(pt_27)
move = Move(Geometry=pt_29, Motion=X_2)  # -> Geometry, Transform
pline_4 = PolyLine(Vertices=move.Geometry, Closed="True")
from_polylines = FromPolylines(Polylines=flatten(pline_4), Weld=-1, Min_Triangulation=False)
ngon = NGon(Mesh=flatten(from_polylines), LineWeight=1)
ngonfaces = NGonFaces(Mesh=ngon)  # -> F, I
crv_13 = Curve(pline_4)
crv_14 = Curve(ngonfaces.F)
explode_3 = Explode(Curve=crv_13, Recursive=True)  # -> Segments, Vertices
crv_15 = Curve(pline_4)
crv_16 = Curve(crv_14)
explode_4 = Explode(Curve=simplify(crv_16), Recursive=True)  # -> Segments, Vertices
rdpoints_2 = RemoveDuplicatePointsKaramba(Point=explode_3.Vertices, LimitDistance=0.005)  # -> OutPoint, Info, Indexes
trim_2 = TrimTree(Tree=explode_4.Segments, Depth=1)
crv_17 = Curve(crv_15)
mesh_19 = Mesh(mesh_12)
rdlines = RemoveDuplicateLinesKaramba3D(Line=trim_2, LimitDistance=0.005)  # -> OutLine, Info, Indexes
wbweave = WeaverbirdsMeshFromLinesWeaveBack(Lines=rdlines.OutLine, MaximumValence=4)
explode_5 = Explode(Curve=crv_17, Recursive=True)  # -> Segments, Vertices
del = DelaunayMesh(Points=rdpoints_2.OutPoint, Plane=PlaneXY(0, 0, 0))
mesh_20 = Mesh(wbweave)
project_3 = ProjectPoint(Point=explode_5.Vertices, Direction=rev_2, Geometry=mesh_19)  # -> Point, Index
pline_5 = PolyLine(Vertices=project_3.Point, Closed=False)
wbnaked_3 = WeaverbirdsNakedBoundary(MeshClosedPolylines=del)
crv_18 = Curve(pline_5)
mesh_21 = Mesh(del)
mesh_22 = Mesh(flatten(mesh_20))
area = Area(Geometry=flatten(mesh_22))  # -> Area, Centroid
crv_19 = Curve(crv_15)
pt_30 = Point(pt_28)
pdecon_2 = Deconstruct(Point=area.Centroid)  # -> XComponent, YComponent, ZComponent
bnd = Bounds(Numbers=area.Area)
bnd_2 = Bounds(Numbers=pdecon_2.YComponent)
wbedges_4 = WeaverbirdsMeshEdges(MeshOrPolylines=crv_19)
dedomain = DeconstructDomain(Domain=bnd)  # -> Start, End
dedomain_2 = DeconstructDomain(Domain=bnd_2)  # -> Start, End
gradient_4 = Gradient(
    LowerLimit=dedomain.Start,
    UpperLimit=dedomain.End,
    Parameter=area.Area,
    stops=[0: RGB(234, 38, 0), 0.25: RGB(234, 126, 0), 0.5: RGB(254, 244, 84), 0.75: RGB(173, 203, 249), 1: RGB(75, 107, 169)])
gradient_5 = Gradient(
    LowerLimit=dedomain_2.End,
    UpperLimit=dedomain_2.Start,
    Parameter=pdecon_2.YComponent,
    stops=[0: RGB(243, 57, 0), 0.1: RGB(236, 27, 60), 0.2: RGB(210, 0, 118), 0.3: RGB(103, 0, 120), 0.4: RGB(39, 72, 161), 0.5: RGB(1, 192, 229), 0.6: RGB(18, 178, 90), 0.7: RGB(79, 186, 8), 0.8: RGB(220, 237, 32), 0.9: RGB(247, 159, 20), 1: RGB(243, 57, 0)])
move_2 = Move(Geometry=pt_30, Motion=X_3)  # -> Geometry, Transform
material = CreateMaterial(
    Diffuse=gradient_4,
    Specular=RGB(255, 255, 255),
    Emission=RGB(0, 0, 0),
    Transparency=Slider(0, range=0..1),
    Shine=Slider(27, range=0..100))
col = Colour(gradient_4)
crv_20 = Curve(wbedges_4)

crv_21 = Curve(crv_20)
pt_31 = Point(pt_24)
rdlines_2 = RemoveDuplicateLinesKaramba(Line=flatten(crv_21), LimitDistance=0.005)  # -> OutLine, Info, Indexes
cir = Circle(Plane=pt_31, Radius="0.04")
crv_22 = Curve(cir)
line_7 = Line(rdlines_2.OutLine)
crv_23 = Curve([line_7, crv_22])
previewlw = CustomPreviewLineweights(Geometry=crv_23, Shader=ColourSwatch(SwatchColor=RGB(0, 0, 0)), Thickness="2", Absolute=False)

preview_3 = CustomPreview(Geometry=flatten(mesh_22), Material=material)
createatts = CreateAttributes(LayerName="faces", Color=col, enableFullPath=False)
dots = DotDisplay(Point=move_2.Geometry, Colour=swatch_7, Size="0.01")  # disabled
previewlw_2 = CustomPreviewLineweights(Geometry=wbedges_4, Shader=swatch_7, Thickness="2", Absolute=False)
bake = BakeGeometry(Bake=Button(), Geometry=mesh_22, Attributes=createatts, DeleteOldBakes=False, PreserveTrees=False)

panel_32 = Panel("""bottom layer
top layer
center layer
total """)
panel_33 = Panel("""asx_b
asx_t
asy_b
asy_t
asx_c
asy_c""")

entwine_6 = Entwine(
    Branch00=ColourSwatch(SwatchColor=RGB(0, 124, 247)),
    Branch01=ColourSwatch(SwatchColor=RGB(1, 35, 97)),
    Branch02=ColourSwatch(SwatchColor=RGB(1, 97, 92)),
    FlattenInputs=True)
panel_34 = Panel("4")

X_4 = UnitX(Factor="6")

X_5 = UnitX(Factor="6")

entwine_7 = Entwine(
    Branch00=ColourSwatch(SwatchColor=RGB(227, 9, 118)),
    Branch01=ColourSwatch(SwatchColor=RGB(214, 204, 4)),
    FlattenInputs=True)

entwine_8 = Entwine(
    Branch00=ColourSwatch(SwatchColor=RGB(0, 255, 38)),
    Branch01=ColourSwatch(SwatchColor=RGB(255, 0, 0)),
    Branch02=ColourSwatch(SwatchColor=RGB(0, 128, 255)),
    FlattenInputs=True)
X_6 = UnitX(Factor="6")

# ---- group: Make RC Design
python_6 = GhPythonScript(run=bool_9, s_mesh=data_8, heights=num_27, covers=num_28, fck=num_29, fy=num_30, fctd_factor=num_31, force_tags=txt_12)  # -> out, s_mesh, asxb, asxt, asyb, asyt, asxc, asyc, ast; inputs run: Boolean, force_tags: list
# ---------- python_6: Python ----------
"""NOTE 18.08.01: Bottom and Top were inverted for compatibility"""

__author__ = "Rafael Pastrana"
__name__ = "Sandwich"
__date__ = "2018.08.01"
__version__ = "0.0.2"

# 1. Import dependencies
import sys
import imp
import rhinoscriptsyntax as rs

# 1-b. Replace with your own path here
# sys.path.append("Z:\projects\streamlines\src\streamlines")

# import materials
# import basic_sandwich

# imp.reload(materials)
# imp.reload(basic_sandwich)

from streamlines.basic_sandwich import ReinforcedShell
from streamlines.materials import Concrete
from streamlines.materials import Rebar


# 2. Create Input Material Data
myConcrete = Concrete(fck)
myRebar = Rebar(fy)
#myConcrete.printSummary()

# 3. Perform Reinforcement Design
my_mesh = s_mesh

asxb = []
asyb = []
asxt = []
asyt = []
asxc = []
asyc = []

ast = []
shells = []

if run is True:
    for idx, f_key in enumerate(s_mesh.c_mesh.faces()):
        forces = s_mesh.c_mesh.get_face_attributes(f_key, force_tags)
        myForces = {str(a): b for a, b in zip(force_tags, forces)}
        
        myShell = ReinforcedShell(idx, myConcrete, myRebar, heights, covers)
        myShell.tcred = myShell.concrete.fctd * fctd_factor
        
        # 4. Perform Reinforcement Design Routine
        myShell.applyForces(**myForces)
        
        # new version 25.08.18
        myShell.get_membrane_forces()
        myShell.get_reinforcement_forces()
        myShell.design_reinforcement()
        
        # 5. Append Results to Output Lists. Bottom and top were inverted
        shells.append(myShell)
        
        asxb.append(myShell.asxt)
        asyb.append(myShell.asyt)
        
        asxt.append(myShell.asxb)
        asyt.append(myShell.asyb)
        
        asxc.append(myShell.asxc)
        asyc.append(myShell.asyc)
        
        ast.append(myShell.ast)
        
        # 6. Set Face Attributes. Bottom and top were inverted
        my_mesh.c_mesh.set_face_attribute(f_key, 'asx_b', myShell.asxt)
        my_mesh.c_mesh.set_face_attribute(f_key, 'asx_t', myShell.asxb)
        my_mesh.c_mesh.set_face_attribute(f_key, 'asy_b', myShell.asyt)
        my_mesh.c_mesh.set_face_attribute(f_key, 'asy_t', myShell.asyb)
        
        my_mesh.c_mesh.set_face_attribute(f_key, 'asx_c', myShell.asxc)
        my_mesh.c_mesh.set_face_attribute(f_key, 'asy_c', myShell.asyc)
        
        my_mesh.c_mesh.set_face_attribute(f_key, 'asx_', (myShell.asxc + myShell.asxt + myShell.asxb))
        my_mesh.c_mesh.set_face_attribute(f_key, 'asy_', (myShell.asyc + myShell.asyt + myShell.asyb))
    
        
    # 6. Retrieve Statistics
    print("# of Elements with Crushed Core: {}".format(len([shell for shell in shells if shell.coreCrush == True])))
    print("# of Elements with Crushed Top Cover: {}".format(len([shell for shell in shells if shell.tsupCrush == True])))
    print("# of Elements with Crushed Bottom Cover: {}".format(len([shell for shell in shells if shell.tinfCrush == True])))
    print("----------------------------------")
    print("Shear Force Vo in Crushed Core Elements: {}".format([shell.vo for shell in shells if shell.coreCrush == True]))
    print("----------------------------------")
# ---------- end python_6 ----------

num_79 = Number(python_6.asyt)
num_80 = Number(python_6.ast)
num_81 = Number(python_6.asyb)
num_82 = Number(python_6.asxb)
num_83 = Number(python_6.asxt)

# ----
num_84 = Number(python_6.asxc)
num_85 = Number(python_6.asyc)
num_86 = Number(num_84)
num_87 = Number(num_85)

# ---- group: Make RC Design (continued)
num_88 = Number(num_82)
num_89 = Number(num_83)
num_90 = Number(num_81)
num_91 = Number(num_79)
entwine_9 = Entwine(Branch00=num_88, Branch01=num_89, Branch02=num_90, Branch03=num_91, Branch04=num_86, Branch05=num_87, FlattenInputs=True)

# ----
entwine_10 = Entwine(Branch00=num_88, Branch01=num_89, Branch02=num_90, Branch03=num_91, FlattenInputs=True)

data_9 = Data(python_6.out)
num_92 = Number(entwine_9)

data_10 = Data(python_6.s_mesh)
num_93 = Number(entwine_10)

# ---- group: s_mesh
data_11 = Data(data_10)

# ----
python_7 = GhPythonScript(s_mesh=data_11, diam=num_54, max_sp=num_55)  # -> out, s_mesh, sp_asx, sp_asy; inputs diam: list, max_sp: list
# ---------- python_7: Python ----------
# 1. Import dependencies
import rhinoscriptsyntax as rs
import Rhino.Geometry as rg
import math


# 1-b. Define Globals
TAG = 'spacing_'
TOL = 1e-6
AS_TAGS = ['asx_', 'asy_']
my_mesh = s_mesh

# 1-c. Define Functions

def get_bar_area(diameter):
    return math.pi * math.pow((diameter / 10), 2) / 4

def steel_area_to_spacing(steel_areas, diameter, max):
    spacings = []
    bar_area = get_bar_area(diameter)
    
    for s_area in steel_areas:
        if s_area < TOL:
            s_area = TOL
        spacing = s_area / bar_area
        spacing = 1 / spacing
        
        if spacing > max:
            spacing = max
        spacings.append(spacing)
    return spacings

# 2. Set Data
for f_key in my_mesh.c_mesh.faces():
    for as_tag in AS_TAGS:
        steel_area = my_mesh.c_mesh.get_face_attribute(f_key, as_tag)
        if as_tag[2] == 'x':
            sp = steel_area_to_spacing([steel_area], diam[0], max_sp[0])[0]
            my_mesh.c_mesh.set_face_attribute(f_key, TAG+as_tag, sp)
            my_mesh.c_mesh.set_face_attribute(f_key, 'bar_diameter_x', diam[0])
            
        elif as_tag[2] == 'y':
            sp = steel_area_to_spacing([steel_area], diam[1], max_sp[1])[0]
            my_mesh.c_mesh.set_face_attribute(f_key, TAG+as_tag, sp)
            my_mesh.c_mesh.set_face_attribute(f_key, 'bar_diameter_y', diam[1])
            
# 3. Get Data

s_mesh = my_mesh
keys = [f_key for f_key in my_mesh.c_mesh.faces()]

sp_asx_ = my_mesh.c_mesh.get_faces_attribute(keys, TAG+AS_TAGS[0])
sp_asy_ = my_mesh.c_mesh.get_faces_attribute(keys, TAG+AS_TAGS[1])

t_sp_asx_ = sorted(sp_asx_)
t_sp_asy_ = sorted(sp_asy_)

print('Spacings for ASX_ min is {0}. max is {1}'.format(t_sp_asx_[0], t_sp_asx_[-1]))
print('Spacings for ASY_ min is {0}. max is {1}'.format(t_sp_asy_[0], t_sp_asy_[-1]))
# ---------- end python_7 ----------
data_12 = Data(python_7.out)
num_94 = Number(python_7.sp_asx)
num_95 = Number(python_7.sp_asy)
data_13 = Data(python_7.s_mesh)

# ---- group: s_mesh
data_14 = Data(data_13)

# ----
python_8 = GhPythonScript(s_mesh=data_14, perc=num_56)  # -> out, s_mesh, face_centers, seeds_x, seeds_y; inputs perc: list
# ---------- python_8: Python ----------
# 1. Import dependencies
import rhinoscriptsyntax as rs
import Rhino.Geometry as rg
import math


# 1-b. Define Globals
my_mesh = s_mesh
TAG = 'spacing_'
TOL = 1e-6
AS_TAGS = ['asx_', 'asy_']
seeds_x = []
seeds_y = []
face_centers = []

# 1-c. Define Functions

# 2. Set and Get Data
as_dir_1 = TAG + AS_TAGS[0]
as_dir_2 = TAG + AS_TAGS[1]
keys = [f_key for f_key in my_mesh.c_mesh.faces()]

max_dir_1 = sorted(my_mesh.c_mesh.get_faces_attribute(keys, as_dir_1))[-1]
max_dir_2 = sorted(my_mesh.c_mesh.get_faces_attribute(keys, as_dir_2))[-1]
print('Max AS in dir X is {} cm2/m. In dir Y is {} cm2/m'.format(max_dir_1, max_dir_2))

for f_key in my_mesh.c_mesh.faces():
    my_as_dir_1 = my_mesh.c_mesh.get_face_attribute(f_key, as_dir_1)
    my_as_dir_2 = my_mesh.c_mesh.get_face_attribute(f_key, as_dir_2)
    pt = rg.Point3d(*my_mesh.c_mesh.face_centroid(f_key))
    
    face_centers.append(pt)
    if my_as_dir_1 <= max_dir_1 * perc[0]:
        seeds_x.append((pt, my_as_dir_1))
    if my_as_dir_2 <= max_dir_2 * perc[1]:
        seeds_y.append((pt, my_as_dir_2))

s_mesh = my_mesh
seeds_x = [seed[0] for seed in sorted(seeds_x, key=lambda x: x[1])]
seeds_y = [seed[0] for seed in sorted(seeds_y, key=lambda x: x[1])]

print('Number of Seeds in X direction is {}'.format(len(seeds_x)))
print('Number of Seeds in Y direction is {}'.format(len(seeds_y)))
# ---------- end python_8 ----------
pt_32 = Point(python_8.seeds_y)

# ---- group: seeds Y
pt_33 = Point(pt_32)

# ----
pt_34 = Point(python_8.seeds_x)

# ---- group: seeds X
pt_35 = Point(pt_34)

# ----
entwine_11 = Entwine(Branch00=pt_35, Branch01=pt_33, FlattenInputs=True)
filter = StreamFilter(Gate=bool_8, Stream1=entwine_11)
dots_2 = DotDisplay(Point=filter, Colour=entwine_7, Size="0.01")

data_15 = Data(python_8.out)
data_16 = Data(python_8.s_mesh)  # disabled
pt_36 = Point(python_8.face_centers)  # disabled

# ---- group: s_mesh
data_17 = Data(data_13)

data_18 = Data(data_13)

data_19 = Data(data_13)

data_20 = Data(data_13)

# ----
python_9 = GhPythonScript(show=bool_13, s_mesh=data_18, vector_tag=txt_14, v_scale=num_34)  # -> out, s_mesh, line_field, node_line_field, centers_line_field, colors_line_field, colors_node_line_field, colors_centers_line_field, vectors_a, vectors_b; inputs show: Boolean
# ---------- python_9: Python ----------
"""Retrieves data from a Structural Mesh object"""

__author__ = "Rafael Pastrana"
__name__ = "Mesh Displayer"
__date__ = "2018.07.24"
__version__ = "0.0.1"


# 1. Import dependencies
import imp
import rhinoscriptsyntax as rs
import sys

# sys.path.append("Z:\projects\streamlines\src\streamlines")
# import display
# imp.reload(display)
# from display import Display

from streamlines.display import Display
import compas.geometry as cg

dsp = Display()

# 2. Start System
my_mesh = s_mesh
v_name = vector_tag
TAG = '_val'

if show is True:
    # vector properties
    line_field = dsp.draw_face_vectors(my_mesh, v_name, v_scale)
    node_line_field = dsp.draw_node_vectors(my_mesh, v_name, v_scale)
    center_vectors = my_mesh.find_vector_face_centers(v_name)
    centers = list(map(lambda x: my_mesh.c_mesh.face_centroid(x), my_mesh.c_mesh.faces()))
    centers_line_field = dsp.draw_vectors(centers, center_vectors, v_scale)
        
    f_color = []
    for f_key in my_mesh.c_mesh.faces():
        val = my_mesh.c_mesh.get_face_attribute(f_key, v_name+TAG)
        if val:
            if val < 0:
                f_color.append(rs.CreateColor(255,0,0))
            else:
                f_color.append(rs.CreateColor(0,0,255))
        else:
            f_color.append(rs.CreateColor(0,0,255))
            
    n_color = []
    for v_key in my_mesh.c_mesh.vertices():
        val = my_mesh.c_mesh.get_vertex_attribute(v_key, v_name+TAG)
        if val < 0:
            n_color.append(rs.CreateColor(0,0,0))
        else:
            n_color.append(rs.CreateColor(0,0,0))
    
    colors_line_field = f_color
    colors_node_line_field = n_color
    colors_centers_line_field = f_color
    
    vectors_a = list(map(lambda x: my_mesh.c_mesh.get_vertex_attribute(x,v_name+'_a'), my_mesh.c_mesh.vertices()))
    vectors_a = list(map(lambda x: rs.CreateVector(*x), vectors_a))
    
    vectors_b = list(map(lambda x: my_mesh.c_mesh.get_vertex_attribute(x,v_name+'_b'), my_mesh.c_mesh.vertices()))
    vectors_b = list(map(lambda x: rs.CreateVector(*x), vectors_b))
# ---------- end python_9 ----------
python_10 = GhPythonScript(show=bool_14, s_mesh=data_19, vector_tag=txt_16, v_scale=num_33)  # -> out, s_mesh, line_field, node_line_field, centers_line_field, colors_line_field, colors_node_line_field, colors_centers_line_field, vectors_a, vectors_b; inputs show: Boolean; same code as python_9
python_11 = GhPythonScript(show=bool_10, s_mesh=data_17, data_tag=txt_18, mode=txt_13)  # -> out, s_mesh, display_mesh, color_data, data_values; inputs show: Boolean
# ---------- python_11: Python ----------
"""Retrieves data from a Structural Mesh object"""

__author__ = "Rafael Pastrana"
__name__ = "Mesh Displayer"
__date__ = "2018.07.24"
__version__ = "0.0.1"


# 1. Import dependencies
import imp
import copy
import rhinoscriptsyntax as rs
import sys
# sys.path.append("Z:\Dropbox\Documentos\ETH Zuerich\ETH MAS Thesis\code\current")

# import Display
# imp.reload(Display)
from streamlines.display import Display

dsp = Display()
my_mesh = s_mesh

# 2. Start System
if show is True:
    display_mesh = my_mesh.gh_mesh
    color_data = None
    data_values = my_mesh.get_data_on_nodes(data_tag, mode)
    # display_mesh, data_values, color_data = dsp.plot_mesh(my_mesh, data_tag, mode)
# ---------- end python_11 ----------
data_21 = Data(python_11.s_mesh)
python_12 = GhPythonScript(s_mesh=data_20, steel_density="7.85")  # -> out, steel_mass, mass_bot, mass_top, mass_center
# ---------- python_12: Python ----------
"""Retrieves data from a Structural Mesh object"""

__author__ = "Rafael Pastrana"
__name__ = "Steel Mass Calculator"
__date__ = "2018.08.02"
__version__ = "0.0.1"


# 1. Import dependencies
import rhinoscriptsyntax as rs

# 2. Define Globals
DENSITY = steel_density  # kg/cm3
TOL = 1e-6
AS_TAGS = ['asx_b', 'asx_t', 'asy_b', 'asy_t', 'asx_c', 'asy_c']

# 3. Start System
my_mesh = s_mesh
face_areas = list(map(lambda x: my_mesh.c_mesh.face_area(x), my_mesh.c_mesh.faces()))

# 4. Get Mass at Bottom Layer
m_asx_b = list(map(lambda x: DENSITY * my_mesh.c_mesh.get_face_attribute(x,AS_TAGS[0]), my_mesh.c_mesh.faces()))
m_asy_b = list(map(lambda x: DENSITY * my_mesh.c_mesh.get_face_attribute(x,AS_TAGS[2]), my_mesh.c_mesh.faces()))

m_asx_t = list(map(lambda x: DENSITY * my_mesh.c_mesh.get_face_attribute(x,AS_TAGS[1]), my_mesh.c_mesh.faces()))
m_asy_t = list(map(lambda x: DENSITY * my_mesh.c_mesh.get_face_attribute(x,AS_TAGS[3]), my_mesh.c_mesh.faces()))

m_asx_c = list(map(lambda x: DENSITY * my_mesh.c_mesh.get_face_attribute(x,AS_TAGS[4]), my_mesh.c_mesh.faces()))
m_asy_c = list(map(lambda x: DENSITY * my_mesh.c_mesh.get_face_attribute(x,AS_TAGS[5]), my_mesh.c_mesh.faces()))

mass_bot = reduce(lambda x, y: x+y, [sum(x)*face_areas[idx] for idx, x in enumerate(zip(m_asx_b, m_asy_b))])
mass_top = reduce(lambda x, y: x+y, [sum(x)*face_areas[idx] for idx, x in enumerate(zip(m_asx_t, m_asy_t))])
mass_center = reduce(lambda x, y: x+y, [sum(x)*face_areas[idx] for idx, x in enumerate(zip(m_asx_c, m_asy_c))])

steel_mass = mass_bot + mass_top + mass_center
# ---------- end python_12 ----------
python_13 = GhPythonScript(x=data_21)  # -> out, a
# ---------- python_13: Python ----------
__author__ = "ARPJ"
__version__ = "2018.08.01"

import rhinoscriptsyntax as rs

print('number of edges is: {}'.format(len([e for e in x.c_mesh.edges()])))
# ---------- end python_13 ----------
num_96 = Number(python_12.steel_mass)
num_97 = Number(python_12.mass_bot)
num_98 = Number(python_12.mass_top)
num_99 = Number(python_12.mass_center)
num_100 = Number(num_99)

num_101 = Number(num_96)
num_102 = Number(num_97)
num_103 = Number(num_98)
data_22 = Data(data_12)
data_23 = Data(data_15)
num_104 = Number(num_92)
data_24 = Data(data_9)
entwine_12 = Entwine(Branch00=num_102, Branch01=num_103, Branch02=num_100, Branch03=num_101, FlattenInputs=True)
num_105 = Number(num_92)
bnd_3 = Bounds(Numbers=num_104)
sort_2 = SortList(Keys=num_105)  # -> Keys, ValuesA
concat = Concatenate(FragmentA=graft(panel_33), FragmentB="domain is:", FragmentC=bnd_3, JoinSeparator=" ")
concat_2 = Concatenate(FragmentA=graft(panel_32), FragmentB="mass is:", FragmentC=entwine_12, FragmentD="kg", JoinSeparator=" ")
panel_35 = Panel(data_22)
panel_36 = Panel(data_23)
panel_37 = Panel(data_24)
reinforcement_areas_domain_cm2_m = Panel(concat)
graph = QuickGraph(sort_2.Keys, SortOrder=0)
reinforcement_areas_domain_cm2_m_2 = Panel(concat_2)

num_106 = Number(python_11.data_values)
mesh_23 = Mesh(python_11.display_mesh)
mesh_24 = Mesh(mesh_23)
wbnaked_4 = WeaverbirdsNakedBoundary(MeshClosedPolylines=mesh_24)

entwine_13 = Entwine(Branch00=wbnaked_4, Branch01=crv_4, Branch02=crv_5, FlattenInputs=True)

col_2 = Colour(python_11.color_data)
line_8 = Line(python_9.centers_line_field)
line_9 = Line(python_9.line_field)
col_3 = Colour(python_9.colors_line_field)
col_4 = Colour(python_9.colors_centers_line_field)
vec_27 = Vector(python_9.vectors_a)
line_10 = Line(python_10.line_field)
line_11 = Line(python_10.centers_line_field)
col_5 = Colour(python_10.colors_line_field)
col_6 = Colour(python_10.colors_centers_line_field)
vec_28 = Vector(python_10.vectors_a)
vec_29 = Vector(python_9.vectors_b)
vec_30 = Vector(python_10.vectors_b)
line_12 = Line(python_9.node_line_field)

line_13 = Line(line_9)
line_14 = Line(line_12)
line_15 = Line(line_8)

line_16 = Line(flatten(line_14))
line_17 = Line(line_16)
end_3 = EndPoints(Curve=graft(line_17))  # -> Start, End
vec2pt_3 = Vector2Pt(PointA=end_3.Start, PointB=end_3.End, Unitize=False)  # -> flatten(Vector), Length
vlen = VectorLength(Vector=vec2pt_3.Vector)
bnd_4 = Bounds(Numbers=vlen)
remap = RemapNumbers(Value=vlen, Source=bnd_4, Target=Domain(0, 1))  # -> Mapped, Clipped
move_3 = Move(Geometry=line_16, Motion=Z_3)  # -> Geometry, Transform
graph_2 = GraphMapper(remap.Mapped, x0=0, x1=1, y0=0, y1=1, container_name="Bezier", cpx=[0, 0, 0.3804347813, 1], cpy=[0, 0, 1, 1])
bnd_5 = Bounds(Numbers=graph_2)
gradient_6 = Gradient(
    LowerLimit="1",
    UpperLimit="-1",
    Parameter=graph_2,
    stops=[0: RGB(255, 0, 0), 0.176: RGB(255, 238, 0), 0.35: RGB(0, 255, 234), 0.504: RGB(35, 4, 128), 0.664: RGB(0, 252, 215), 0.843: RGB(255, 255, 0), 1: RGB(255, 0, 47)])
avr_2 = Average(Input=[end_3.Start, end_3.End])  # -> flatten(ArithmeticMean)
remap_2 = RemapNumbers(Value=graph_2, Source=bnd_5, Target="1 to 1")  # -> Mapped, Clipped
scale = Scale(Geometry=line_17, Center=avr_2, Factor=remap_2.Mapped)  # -> Geometry, Transform
line_18 = Line(scale.Geometry)
col_7 = Colour(gradient_6)
preview_4 = CustomPreview(Geometry=line_18, Material=swatch_6)
preview_5 = CustomPreview(Geometry=line_17, Material=col_7)
col_8 = Colour(col_7)
line_19 = Line(line_18)
graft_17 = GraftTree(Tree=col_8, IncludeEmptyLists=True, IncludeNullItems=True)
graft_18 = GraftTree(Tree=line_19, IncludeEmptyLists=True, IncludeNullItems=True)
createatts_2 = CreateAttributes(LayerName="principal_stress_mid_2", Color=graft_17, enableFullPath=False)
bake_2 = BakeGeometry(Bake=Button(), Geometry=graft_18, Attributes=createatts_2, DeleteOldBakes=False, PreserveTrees=False)
line_20 = Line(python_10.node_line_field)

line_21 = Line(line_10)
line_22 = Line(line_20)
line_23 = Line(line_11)

line_24 = Line(flatten(line_22))
line_25 = Line(line_24)
end_4 = EndPoints(Curve=graft(line_25))  # -> Start, End
vec2pt_4 = Vector2Pt(PointA=end_4.Start, PointB=end_4.End, Unitize=False)  # -> flatten(Vector), Length
vlen_2 = VectorLength(Vector=vec2pt_4.Vector)
bnd_6 = Bounds(Numbers=vlen_2)
remap_3 = RemapNumbers(Value=vlen_2, Source=bnd_6, Target=Domain(0, 1))  # -> Mapped, Clipped
move_4 = Move(Geometry=line_24, Motion=Z_4)  # -> Geometry, Transform
graph_3 = GraphMapper(
    remap_3.Mapped,
    x0=0,
    x1=1,
    y0=0,
    y1=1,
    container_name="Bezier",
    cpx=[0, 0, 1, 1],
    cpy=[0, 0.3821747303, 0.5108695626, 1])
bnd_7 = Bounds(Numbers=graph_3)
gradient_7 = Gradient(
    LowerLimit="1",
    UpperLimit="-1",
    Parameter=graph_3,
    stops=[0: RGB(255, 0, 0), 0.176: RGB(255, 238, 0), 0.35: RGB(0, 255, 234), 0.504: RGB(35, 4, 128), 0.664: RGB(0, 252, 215), 0.843: RGB(255, 255, 0), 1: RGB(255, 0, 47)])
avr_3 = Average(Input=[end_4.Start, end_4.End])  # -> flatten(ArithmeticMean)
remap_4 = RemapNumbers(Value=graph_3, Source=bnd_7, Target="1 to 1")  # -> Mapped, Clipped
scale_2 = Scale(Geometry=line_25, Center=avr_3, Factor=remap_4.Mapped)  # -> Geometry, Transform
line_26 = Line(scale_2.Geometry)
col_9 = Colour(gradient_7)
preview_6 = CustomPreview(Geometry=line_26, Material=swatch_6)
preview_7 = CustomPreview(Geometry=line_25, Material=col_9)
col_10 = Colour(col_9)
line_27 = Line(line_26)
graft_19 = GraftTree(Tree=col_10, IncludeEmptyLists=True, IncludeNullItems=True)
graft_20 = GraftTree(Tree=line_27, IncludeEmptyLists=True, IncludeNullItems=True)
createatts_3 = CreateAttributes(LayerName="principal_stress_mid_1", Color=graft_19, enableFullPath=False)
bake_3 = BakeGeometry(Bake=Button(), Geometry=graft_20, Attributes=createatts_3, DeleteOldBakes=False, PreserveTrees=False)
data_25 = Data(python_9.s_mesh)
col_11 = Colour(python_9.colors_node_line_field)

col_12 = Colour(col_3)
col_13 = Colour(col_11)
col_14 = Colour(col_4)

entwine_14 = Entwine(Branch00=line_13, Branch01=line_14, Branch02=line_15, FlattenInputs=True)
entwine_15 = Entwine(Branch00=col_12, Branch01=col_13, Branch02=col_14, FlattenInputs=True)
move_5 = Move(Geometry=entwine_14, Motion=X_4)  # -> Geometry, Transform
preview_8 = CustomPreview(Geometry=line_16, Material=ColourSwatch(SwatchColor=RGB(255, 255, 255)))

data_26 = Data(python_10.s_mesh)

# ---- group: s_mesh
data_27 = Data(data_26)

# ----
python_14 = GhPythonScript(show=bool_11, s_mesh=data_27, vector_tag=txt_15, tol=num_32)  # -> out, s_mesh, face_neg, face_null, face_pos; inputs show: Boolean
# ---------- python_14: Python ----------
"""Retrieves data from a Structural Mesh object"""

__author__ = "Rafael Pastrana"
__name__ = "Mesh Displayer"
__date__ = "2018.07.24"
__version__ = "0.0.1"


# 1. Import dependencies
import rhinoscriptsyntax as rs

# 2. Start System
my_mesh = s_mesh
v_name = vector_tag

if show is True:
    my_mesh.get_face_labels(v_name, tol)
    face_neg, face_null, face_pos = my_mesh.stream_face_labels()
# ---------- end python_14 ----------
data_28 = Data(python_14.s_mesh)

# ---- group: s_mesh
data_29 = Data(data_28)

# ----
python_15 = GhPythonScript(show=bool_12, s_mesh=data_29)  # -> out, s_mesh, face_planes, edge_planes; inputs show: Boolean
# ---------- python_15: Python ----------
"""Retrieves data from a Structural Mesh object"""

__author__ = "Rafael Pastrana"
__name__ = "Mesh Displayer"
__date__ = "2018.07.24"
__version__ = "0.0.1"


# 1. Import dependencies
import rhinoscriptsyntax as rs

# 2. Start System
my_mesh = s_mesh

if show is True:
    # plane properties
    face_planes = list(map(lambda x: my_mesh.cMesh.get_face_attribute(x,'plane'), my_mesh.cMesh.faces()))
    face_planes = [rs.PlaneFromNormal(x[0], x[1]) for x in face_planes]
    
    edge_planes = list(map(lambda x: my_mesh.cMesh.get_edge_attribute(x,'plane'), my_mesh.cMesh.edges()))
    edge_planes = [rs.PlaneFromNormal(x[0], x[1]) for x in edge_planes if x is not None]

s_mesh = s_mesh
# ---------- end python_15 ----------
pt_37 = Point(python_14.face_neg)
pt_38 = Point(python_14.face_null)
pt_39 = Point(python_14.face_pos)

pt_40 = Point(pt_37)
pt_41 = Point(pt_38)
pt_42 = Point(pt_39)

entwine_16 = Entwine(Branch00=pt_40, Branch01=pt_41, Branch02=pt_42, FlattenInputs=True)
move_6 = Move(Geometry=entwine_16, Motion=X_6)  # -> Geometry, Transform
dots_3 = DotDisplay(Point=move_6.Geometry, Colour=entwine_8, Size="0.01")  # disabled

cir_2 = Circle(Plane=entwine_16, Radius="0.05")
preview_9 = CustomPreview(Geometry=cir_2, Material=entwine_8)
data_30 = Data(python_15.s_mesh)
pln_3 = Plane(python_15.edge_planes)
pln_4 = Plane(python_15.face_planes)
col_15 = Colour(python_10.colors_node_line_field)

col_16 = Colour(col_5)
col_17 = Colour(col_15)
col_18 = Colour(col_6)

entwine_17 = Entwine(Branch00=line_21, Branch01=line_22, Branch02=line_23, FlattenInputs=True)
entwine_18 = Entwine(Branch00=col_16, Branch01=col_17, Branch02=col_18, FlattenInputs=True)
move_7 = Move(Geometry=entwine_17, Motion=X_5)  # -> Geometry, Transform
preview_10 = CustomPreview(Geometry=line_24, Material=ColourSwatch(SwatchColor=RGB(255, 255, 255)))

panel_38 = Panel(python_11.out)
data_31 = Data(data_13)
data_32 = Data(data_13)
python_16 = GhPythonScript(
    run=bool_19,
    s_mesh=flatten(data_31),
    weights=num_57,
    dL=num_58,
    min_length=num_59,
    vector_tag=txt_20,
    as_tag=txt_19,
    min_sp=num_60,
    uni_sp=bool_20,
    num_samples=int_17,
    strat_factor=num_61,
    others_prox=num_62,
    start_prox=num_63,
    self_prox=num_64,
    iterations=num_65,
    start_pt=pt_19)  # -> out, str_system; inputs weights: list, uni_sp: Boolean, num_samples: Int32, iterations: Int32, start_pt: Point3d
# ---------- python_16: Python ----------
fac__author__ = "Rafael Pastrana"
__name__ = "Streamliner"
__date__ = "2018.08.05"
__version__ = "0.0.4"


# 0. Import dependencies
import sys
import imp
import rhinoscriptsyntax as rs
import clr
clr.AddReference("Grasshopper")
import Grasshopper.Kernel.Data.GH_Path as ghpath
import Grasshopper.DataTree as datatree
import System
import ghpythonlib.parallel as gh_parallel
 
# 0-b. Replace with your own path here
# sys.path.append("Z:\projects\streamlines\src\streamlines")
import streamlines
imp.reload(streamlines)
from streamlines.streamsystem import Streamsystem

# 1. Define Globals 
TAG = 'spacing_'
TOL = 1e-6
AS_TAGS = [TAG+'asx_', TAG+'asy_']
MIN_SP = min_sp  # minimum backup separation for objects
UNI_SP = uni_sp  # Ignore Separation Map from RC Design?

W_1 = [weights[0], weights[1], weights[2]]
W_2= [weights[3], weights[4], weights[5]]
vec_tag_dict = {'n_1':'n_2', 'n_2':'n_1', 'm_1':'m_2', 'm_2':'m_1', 'ps_1_top':'ps_2_top', 'ps_1_bot':'ps_2_bot', 'ps_1_mid':'ps_2_mid', 'ps_2_top':'ps_1_top', 'ps_2_bot':'ps_1_bot', 'ps_2_mid':'ps_1_mid', 'custom_1':'custom_2', 'custom_2':'custom_1'}

# 2. Establish Tag Convention
if as_tag == 'asx_':
    as_dir = AS_TAGS[0]
    w = W_1
    vector_tag = vector_tag

elif as_tag == 'asy_':
    as_dir = AS_TAGS[1]
    w = W_2
    vector_tag = vec_tag_dict[vector_tag]

# 3. Create Data Trees for collecting output
streamlines = datatree[System.Object]()
streamlines_objects = datatree[System.Object]()
short_streamlines = datatree[System.Object]()
offsets = datatree[System.Object]()

# 4. Run Streamlines on Direction 1
if run :
    str_system = Streamsystem(s_mesh, as_dir, dL, MIN_SP, UNI_SP)
    str_system.set_tracing_data(vector_tag, w, min_length)
    str_system.make_streamlines_jobard(strat_factor, others_prox, start_prox, self_prox, num_samples, iterations, start_pt)
# ---------- end python_16 ----------
python_17 = GhPythonScript(
    run=bool_21,
    s_mesh=flatten(data_32),
    weights=num_67,
    dL=num_69,
    min_length=num_66,
    vector_tag=txt_21,
    as_tag=txt_22,
    min_sp=num_70,
    uni_sp=bool_22,
    num_samples=int_18,
    strat_factor=num_71,
    others_prox=num_72,
    start_prox=num_68,
    self_prox=num_73,
    iterations=num_74,
    start_pt=pt_20)  # -> out, str_system; inputs weights: list, uni_sp: Boolean, num_samples: Int32, iterations: Int32, start_pt: Point3d
# ---------- python_17: Python ----------
__author__ = "Rafael Pastrana"
__name__ = "Streamliner"
__date__ = "2018.08.05"
__version__ = "0.0.4"


# 0. Import dependencies
import sys
import imp
import rhinoscriptsyntax as rs
import clr
clr.AddReference("Grasshopper")
import Grasshopper.Kernel.Data.GH_Path as ghpath
import Grasshopper.DataTree as datatree
import System
import ghpythonlib.parallel as gh_parallel
 
# 0-b. Replace with your own path here
# sys.path.append("Z:\projects\streamlines\src\streamlines")
import streamlines
imp.reload(streamlines)
from streamlines.streamsystem import Streamsystem

# 1. Define Globals 
TAG = 'spacing_'
TOL = 1e-6
AS_TAGS = [TAG+'asx_', TAG+'asy_']
MIN_SP = min_sp  # minimum backup separation for objects
UNI_SP = uni_sp  # Ignore Separation Map from RC Design?

W_1 = [weights[0], weights[1], weights[2]]
W_2= [weights[3], weights[4], weights[5]]
vec_tag_dict = {'n_1':'n_2', 'n_2':'n_1', 'm_1':'m_2', 'm_2':'m_1', 'ps_1_top':'ps_2_top', 'ps_1_bot':'ps_2_bot', 'ps_1_mid':'ps_2_mid', 'ps_2_top':'ps_1_top', 'ps_2_bot':'ps_1_bot', 'ps_2_mid':'ps_1_mid', 'custom_1':'custom_2', 'custom_2':'custom_1'}

# 2. Establish Tag Convention
if as_tag == 'asx_':
    as_dir = AS_TAGS[0]
    w = W_1
    vector_tag = vector_tag

elif as_tag == 'asy_':
    as_dir = AS_TAGS[1]
    w = W_2
    vector_tag = vec_tag_dict[vector_tag]

# 3. Create Data Trees for collecting output
streamlines = datatree[System.Object]()
streamlines_objects = datatree[System.Object]()
short_streamlines = datatree[System.Object]()
offsets = datatree[System.Object]()

# 4. Run Streamlines on Direction 1
if run :
    str_system = Streamsystem(s_mesh, as_dir, dL, MIN_SP, UNI_SP)
    str_system.set_tracing_data(vector_tag, w, min_length)
    str_system.make_streamlines_jobard(strat_factor, others_prox, start_prox, self_prox, num_samples, iterations)

# 5. Collect Streamlines
#    for idx, streamline in enumerate(str_system.streamlines):
#        rh_pts = []
#        for point in streamline.polyline.points:
#            rh_pts.append(rs.AddPoint(*point))
#        streamlines.AddRange(rh_pts, ghpath(idx))
#        streamlines_objects.Add(streamline, ghpath(idx))
#        
#    for idx, streamline in enumerate(str_system.short_streamlines):
#        rh_pts = []
#        for point in streamline.polyline.points:
#            rh_pts.append(rs.AddPoint(*point))
#        short_streamlines.AddRange(rh_pts, ghpath(idx))
#   
#    for idx, streamline in enumerate(str_system.offsets):
#        rh_pts = []
#        for point in streamline.polyline.points:
#            rh_pts.append(rs.AddPoint(*point))
#        offsets.AddRange(rh_pts, ghpath(idx))
#        
#    seed_pts = str_system.seed_pts
#    first_pt = str_system.first_pt


# if run_2:
#     print('dir 2')
#     myStreamSystem = StreamSystem(s_mesh, seeds_2, as_dir_2, dL, MIN_SP, UNI_SP)
#     myStreamSystem.set_data_mebarki(vector_tag_2, W_2, min_length)
# 
#     all_seeds = seeds_2
#     if PARALLEL is True:
#         rh_pts = gh_parallel.run(myStreamSystem.make_streamline_mebarki_parallel, [all_seeds], True)
#     else:
#         rh_pts = myStreamSystem.make_streamline_mebarki_parallel([all_seeds])
# 
#     for idx, pts in enumerate(rh_pts):
#         if pts:
#            streamlines_2.AddRange(pts, ghpath(idx))
# ---------- end python_17 ----------
data_33 = Data(python_16.str_system)
data_34 = Data(python_17.str_system)
panel_39 = Panel(python_16.out)
data_35 = Data(data_33)
data_36 = Data(data_34)
python_18 = GhPythonScript(streamsystem=data_35)  # -> out, offsets, first_pt, seed_pts, streamlines, streamlines_objects, short_streamlines
# ---------- python_18: Python ----------
__author__ = "Rafael Pastrana"
__name__ = "Streamliner"
__date__ = "2018.08.05"
__version__ = "0.0.4"


# 0. Import dependencies
import sys
import imp
import rhinoscriptsyntax as rs
import clr
clr.AddReference("Grasshopper")
import Grasshopper.Kernel.Data.GH_Path as ghpath
import Grasshopper.DataTree as datatree
import System
import ghpythonlib.parallel as gh_parallel
 
# 0-b. Replace with your own path here
# sys.path.append("Z:\Dropbox\Documentos\ETH Zuerich\ETH MAS Thesis\code\current")
#import streamsystem
#imp.reload(streamsystem)
#from streamsystem import Streamsystem


# 1. Define Globals 
streamlines = datatree[System.Object]()
streamlines_objects = datatree[System.Object]()
short_streamlines = datatree[System.Object]()
offsets = datatree[System.Object]()


# 5. Collect Streamlines
if streamsystem is not None:
    str_system = streamsystem
    
    for idx, streamline in enumerate(str_system.streamlines):
        rh_pts = []
        for point in streamline.polyline.points:
            rh_pts.append(rs.AddPoint(*point))
        streamlines.AddRange(rh_pts, ghpath(idx))
        streamlines_objects.Add(streamline, ghpath(idx))
        
    for idx, streamline in enumerate(str_system.short_streamlines):
        rh_pts = []
        for point in streamline.polyline.points:
            rh_pts.append(rs.AddPoint(*point))
        short_streamlines.AddRange(rh_pts, ghpath(idx))
    
    for idx, streamline in enumerate(str_system.offsets):
        rh_pts = []
        for point in streamline.polyline.points:
            rh_pts.append(rs.AddPoint(*point))
        offsets.AddRange(rh_pts, ghpath(idx))
        
    seed_pts = str_system.seed_pts
    first_pt = str_system.first_pt
# ---------- end python_18 ----------
panel_40 = Panel(python_17.out)
python_19 = GhPythonScript(streamsystem=data_36)  # -> out, offsets, first_pt, seed_pts, streamlines, streamlines_objects, short_streamlines
# ---------- python_19: Python ----------
__author__ = "Rafael Pastrana"
__name__ = "Streamliner"
__date__ = "2018.08.05"
__version__ = "0.0.4"


# 0. Import dependencies
import sys
import imp
import rhinoscriptsyntax as rs
import clr
clr.AddReference("Grasshopper")
import Grasshopper.Kernel.Data.GH_Path as ghpath
import Grasshopper.DataTree as datatree
import System
import ghpythonlib.parallel as gh_parallel
 
# 0-b. Replace with your own path here
sys.path.append("Z:\Dropbox\Documentos\ETH Zuerich\ETH MAS Thesis\code\current")
#import streamsystem
#imp.reload(streamsystem)
#from streamsystem import Streamsystem


# 1. Define Globals 
streamlines = datatree[System.Object]()
streamlines_objects = datatree[System.Object]()
short_streamlines = datatree[System.Object]()
offsets = datatree[System.Object]()


# 5. Collect Streamlines
if streamsystem is not None:
    str_system = streamsystem
    
    for idx, streamline in enumerate(str_system.streamlines):
        rh_pts = []
        for point in streamline.polyline.points:
            rh_pts.append(rs.AddPoint(*point))
        streamlines.AddRange(rh_pts, ghpath(idx))
        streamlines_objects.Add(streamline, ghpath(idx))
        
    for idx, streamline in enumerate(str_system.short_streamlines):
        rh_pts = []
        for point in streamline.polyline.points:
            rh_pts.append(rs.AddPoint(*point))
        short_streamlines.AddRange(rh_pts, ghpath(idx))
    
    for idx, streamline in enumerate(str_system.offsets):
        rh_pts = []
        for point in streamline.polyline.points:
            rh_pts.append(rs.AddPoint(*point))
        offsets.AddRange(rh_pts, ghpath(idx))
        
    seed_pts = str_system.seed_pts
    first_pt = str_system.first_pt
# ---------- end python_19 ----------
pt_43 = Point(python_18.first_pt)
pt_44 = Point(python_18.offsets)
pt_45 = Point(python_18.seed_pts)
pt_46 = Point(python_18.streamlines)
data_37 = Data(python_18.streamlines_objects)
pt_47 = Point(python_18.short_streamlines)
pt_48 = Point(python_19.streamlines)
pt_49 = Point(python_19.short_streamlines)
pt_50 = Point(python_19.seed_pts)
data_38 = Data(python_19.streamlines_objects)
pt_51 = Point(python_19.first_pt)
pt_52 = Point(python_19.offsets)

pt_53 = Point(pt_44)
pt_54 = Point(pt_46)
pline_6 = PolyLine(Vertices=pt_54, Closed=False)
pline_7 = PolyLine(Vertices=pt_53, Closed=False)
crv_24 = Curve(pline_6)
crv_25 = Curve(pline_7)

pt_55 = Point(pt_52)
pt_56 = Point(pt_48)
pline_8 = PolyLine(Vertices=pt_56, Closed=False)
pline_9 = PolyLine(Vertices=pt_55, Closed=False)
crv_26 = Curve(pline_9)
crv_27 = Curve(pline_8)

crv_28 = Curve(crv_24)
crv_29 = Curve(crv_27)
tstat_2 = TreeStatistics(Tree=crv_28)  # -> Paths, Length, Count
tstat_3 = TreeStatistics(Tree=crv_29)  # -> Paths, Length, Count
series_2 = Series(Start=0, Step=1, Count=tstat_2.Count)
series_3 = Series(Start=0, Step=1, Count=tstat_3.Count)
gradient_8 = Gradient(
    LowerLimit=0,
    UpperLimit=expr("x-1", tstat_2.Count),
    Parameter=series_2,
    stops=[0: RGB(255, 255, 255), 0.498: RGB(89, 147, 247), 1: RGB(20, 2, 107)])
gradient_9 = Gradient(
    LowerLimit=0,
    UpperLimit=expr("x-1", tstat_3.Count),
    Parameter=series_3,
    stops=[0: RGB(255, 255, 255), 0.498: RGB(247, 89, 89), 1: RGB(107, 2, 2)])
graft_21 = GraftTree(Tree=gradient_8, IncludeEmptyLists=True, IncludeNullItems=True)
graft_22 = GraftTree(Tree=gradient_9, IncludeEmptyLists=True, IncludeNullItems=True)
smoothpline = SmoothPolyline(Polyline=crv_28, Strength=1, Times="50")
smoothpline_2 = SmoothPolyline(Polyline=crv_29, Strength=1, Times="50")
preview_11 = CustomPreview(Geometry=smoothpline, Material=ColourSwatch(SwatchColor=RGB(255, 0, 0)))
preview_12 = CustomPreview(Geometry=smoothpline_2, Material=ColourSwatch(SwatchColor=RGB(0, 0, 0)))
crv_30 = Curve(crv_27)
crv_31 = Curve(crv_24)
entwine_19 = Entwine(Branch00=crv_31, Branch01=crv_30, FlattenInputs=True)
flatten = FlattenTree(Tree=entwine_19, Path="{0}")
crv_32 = Curve(flatten)
crv_33 = Curve(entwine_19)
crv_34 = Curve(crv_33)
mirror = Mirror(Geometry=crv_34, Plane=xz)  # -> Geometry, Transform
merge_10 = Merge(Data1=crv_34, Data2=mirror.Geometry)  # -> simplify(Result)
split_2 = SplitTree(Data=merge_10, Masks=flatten("{2}"))  # -> Positive, Negative
join = JoinCurves(Curves=split_2.Negative, Preserve=False)  # -> simplify(Curves)
ext = ExtendCurve(Curve=join, Type=0, Start="0.05", End="0.05")
merge_11 = Merge(Data1=split_2.Positive, Data2=ext, Data3=explode_2.Segments)  # -> simplify(Result)
crv_35 = Curve(merge_11)
crv_36 = Curve(crv_35)
flatten_2 = FlattenTree(Tree=crv_36, Path="{0}")
crv_37 = Curve(flatten_2)
crv_38 = Curve(crv_37)
crv_39 = Curve(reparameterize(crv_38))
graft_23 = GraftTree(Tree=crv_39, IncludeEmptyLists=True, IncludeNullItems=True)  # -> simplify(Tree)
flatten_3 = FlattenTree(Tree=crv_39, Path="{0}")
group = Group(Objects=flatten_3)
tstat_4 = TreeStatistics(Tree=graft_23)  # -> Paths, Length, Count
dup_2 = DuplicateData(Data=group, Number=tstat_4.Count, Order=True)
series_4 = Series(Start=0, Step=1, Count=tstat_4.Count)
ungroup = Ungroup(Group=dup_2)
graft_24 = GraftTree(Tree=series_4, IncludeEmptyLists=True, IncludeNullItems=True)
cull_i_3 = CullIndex(List=ungroup, Indices=graft_24, Wrap=True)
match = MatchTree(Tree=cull_i_3, Guide=graft_23)
ccx = CurveCurve(CurveA=graft_23, CurveB=match)  # -> Points, ParamsA, ParamsB
pt_57 = Point(ccx.Points)
num_107 = Number(ccx.ParamsA)
crv_40 = Curve(reparameterize(crv_38))
pt_58 = Point(pt_57)
simplify = SimplifyTree(Tree=pt_58, Front=False)
graft_25 = GraftTree(Tree=crv_40, IncludeEmptyLists=True, IncludeNullItems=True)
trim_3 = TrimTree(Tree=simplify, Depth=1)
simplify_2 = SimplifyTree(Tree=graft_25, Front=False)
crv_cp_2 = CurveClosestPoint(Point=trim_3, Curve=simplify_2)  # -> Point, Parameter, Distance
smaller_4 = SmallerThan(FirstNumber=crv_cp_2.Distance, SecondNumber="0.001")  # -> SmallerThan, OrEqualTo
cull_3 = CullPattern(List=crv_cp_2.Parameter, CullPattern=smaller_4.SmallerThan)
cull_4 = CullPattern(List=crv_cp_2.Point, CullPattern=smaller_4.SmallerThan)
clean = CleanTree(RemoveNulls=True, RemoveInvalid=True, RemoveEmpty=False, Tree=cull_3)
clean_2 = CleanTree(RemoveNulls=True, RemoveInvalid=True, RemoveEmpty=False, Tree=cull_4)
rdpoints_3 = RemoveDuplicatePointsKaramba(Point=flatten(clean_2), LimitDistance=0.005)  # -> OutPoint, Info, Indexes
shatter = Shatter(Curve=simplify_2, Parameters=clean)  # -> simplify(Segments)
pt_59 = Point(rdpoints_3.OutPoint)
reb = RebuildCurve(Curve=shatter, Degree="3", Count="10", Tangents=False)
crv_41 = Curve(reb)
crv_42 = Curve(crv_41)
crv_43 = Curve(crv_41)
end_5 = EndPoints(Curve=crv_42)  # -> Start, End
join_2 = JoinCurves(Curves=crv_43, Preserve=False)
ln = Line(StartPoint=end_5.Start, EndPoint=end_5.End)  # -> simplify(Line)
crv_44 = Curve(join_2)
line_28 = Line(ln)
line_29 = Line(line_28)
flatten_4 = FlattenTree(Tree=line_29, Path="{0}")
rdlines_3 = RemoveDuplicateLinesKaramba(Line=flatten_4, LimitDistance="0.005")  # -> OutLine, Info, Indexes
line_topo_2 = LineTopology(ListOfLines=rdlines_3.OutLine, Tolerance="0.005")  # -> ListOfPoints, LinePointStructure, PointPointStructure, PointLineStructure
lng_3 = ListLength(List=line_topo_2.PointPointStructure)
larger = LargerThan(FirstNumber=lng_3, SecondNumber="2")  # -> LargerThan, OrEqualTo
flatten_5 = FlattenTree(Tree=larger.OrEqualTo, Path="{0}")
mindex = MemberIndex(Set=flatten_5, Member=bool_23)  # -> Index, Count
replace = ReplaceItems(List=line_topo_2.ListOfPoints, Indices=mindex.Index, Wrap=False)
item_14 = ListItem(List=replace, Index=line_topo_2.LinePointStructure, Wrap=True)
pline_10 = PolyLine(Vertices=item_14, Closed=False)  # -> flatten(Polyline)
clean_3 = CleanTree(RemoveNulls=True, RemoveInvalid=True, RemoveEmpty=False, Tree=pline_10)
crv_45 = Curve(clean_3)

crv_46 = Curve(crv_44)
pt_60 = Point(pt_22)
explode_6 = Explode(Curve=crv_46, Recursive=True)  # -> Segments, simplify(Vertices)
python_20 = GhPythonScript(pts=pt_60, y=explode_6.Vertices, tol=Slider(0.01, range=0..0.01))  # -> out, a; inputs pts: list of Point3d, y: tree of Point3d
# ---------- python_20: Python ----------
__author__ = "ARPJ"
__version__ = "2018.09.16"

import rhinoscriptsyntax as rs
import clr
clr.AddReference("Grasshopper")
import Grasshopper.Kernel.Data.GH_Path as ghpath
import Grasshopper.DataTree as datatree
import System
 
a = datatree[System.Object]()
import compas.geometry as cg
from compas.geometry import KDTree

search_points = list(map(lambda x: [x.X, x.Y, x.Z], pts))
search_tree = KDTree(search_points)

for idx, branch in enumerate(y.Branches):

    for point in branch:
        pt = [point.X, point.Y, point.Z]
        nbr, label, d = search_tree.nearest_neighbor(pt)
        print('distance is {}'.format(d))
        if d <= tol:
            a.Add(point, ghpath(idx))
# ---------- end python_20 ----------
pline_11 = PolyLine(Vertices=python_20.a, Closed=False)
intcrv = Interpolate(Vertices=python_20.a, Degree="3", Periodic=False, KnotStyle=1)  # -> Curve, Length, Domain
crv_47 = Curve(pline_11)

mesh_25 = Mesh(mesh_23)

demesh_3 = DeconstructMesh(Mesh=mesh_25)  # -> Vertices, Faces, Colours, Normals

num_108 = Number(num_106)
bnd_8 = Bounds(Numbers=num_108)
python_21 = GhPythonScript(x=num_108)  # -> out, a; inputs x: list
# ---------- python_21: Python ----------
__author__ = "ARPJ"
__version__ = "2018.08.01"

import rhinoscriptsyntax as rs

def normalise_data(data, cmin=None, cmax=None):
    fmax = cmax if cmax is not None else max([abs(x) for x in data])
    fmin = cmin if cmin is not None else min([abs(x) for x in data])
    fabs = max([abs(fmin), abs(fmax)])

    fscaled = []
    for value in data:
        new_val = value / fabs
        if new_val > 1:
            new_val = 1
        elif new_val < -1:
            new_val = -1
        fscaled.append(new_val)
    return fscaled

a = normalise_data(x)
# ---------- end python_21 ----------
dedomain_3 = DeconstructDomain(Domain=bnd_8)  # -> Start, End
range_5 = Range(Domain=bnd_8, Steps="15")
neg_3 = Negative(Value=dedomain_3.End)
gradient_10 = Gradient(
    LowerLimit=neg_3,
    UpperLimit=dedomain_3.End,
    Parameter=range_5,
    stops=[0: RGB(255, 0, 0), 0.176: RGB(255, 238, 0), 0.35: RGB(0, 255, 234), 0.504: RGB(35, 4, 128), 0.664: RGB(0, 252, 215), 0.843: RGB(255, 255, 0), 1: RGB(255, 0, 47)])
gradient_11 = Gradient(
    LowerLimit="-1",
    UpperLimit="1",
    Parameter=python_21.a,
    stops=[0: RGB(255, 0, 0), 0.176: RGB(255, 238, 0), 0.35: RGB(0, 255, 234), 0.504: RGB(35, 4, 128), 0.664: RGB(0, 252, 215), 0.843: RGB(255, 255, 0), 1: RGB(255, 0, 47)])
num_109 = Number(range_5)
col_19 = Colour(gradient_10)

gradient_12 = Gradient(
    LowerLimit="-1",
    UpperLimit="1",
    Parameter=python_21.a,
    stops=[0: RGB(255, 0, 0), 0.254: RGB(255, 238, 0), 0.423: RGB(0, 255, 234), 0.504: RGB(35, 4, 128), 0.612: RGB(0, 252, 215), 0.744: RGB(255, 255, 0), 1: RGB(255, 0, 47)])
gradient_13 = Gradient(
    LowerLimit="-1",
    UpperLimit="1",
    Parameter=python_21.a,
    stops=[0: RGB(255, 0, 0), 0.254: RGB(255, 238, 0), 0.423: RGB(0, 255, 234), 0.504: RGB(35, 4, 128), 0.56: RGB(0, 252, 215), 0.719: RGB(255, 255, 0), 1: RGB(255, 0, 47)])
gradient_14 = Gradient(
    LowerLimit="-1",
    UpperLimit="1",
    Parameter=python_21.a,
    stops=[0: RGB(255, 0, 0), 0.254: RGB(255, 238, 0), 0.423: RGB(0, 255, 234), 0.767: RGB(35, 4, 128), 0.843: RGB(0, 252, 215), 0.925: RGB(255, 255, 0), 1: RGB(255, 0, 47)])
num_110 = Number(python_21.a)

col_20 = Colour(gradient_14)

col_21 = Colour(col_20)

conmesh = ConstructMesh(Vertices=demesh_3.Vertices, Faces=demesh_3.Faces, Colours=col_21)
move_8 = Move(Geometry=conmesh, Motion=X)  # -> Geometry, Transform
wbedges_5 = WeaverbirdsMeshEdges(MeshOrPolylines=move_8.Geometry)
mblur = BlurMesh(Mesh=conmesh, Iterations=1)
mesh_26 = Mesh(mblur)

num_111 = Number(num_109)
col_22 = Colour(col_19)
legend_4 = Legend(Colour=col_22, Tags=num_111, LegendType=1)

# ==== cluster Cluster
mesh = ClusterInput()
vec = ClusterInput()
mesh_2 = Mesh(mesh)
vec_2 = Vector(vec)
facen = FaceNormals(Mesh=mesh_2)  # -> Centers, Normals
pl = PlaneNormal(Origin=facen.Centers, ZAxis=facen.Normals)
move = Move(Geometry=facen.Centers, Motion=vec_2)  # -> Geometry, Transform
project = Project(Geometry=move.Geometry, Plane=pl)  # -> Geometry, Transform
vec2pt = Vector2Pt(PointA=facen.Centers, PointB=project.Geometry, Unitize="True")  # -> Vector, Length
xprod = CrossProduct(VectorA=facen.Normals, VectorB=vec2pt.Vector, Unitize="True")  # -> Vector, Length
vec_3 = Vector(xprod.Vector)
vec_4 = Vector(vec2pt.Vector)
vec_5 = ClusterOutput(vec_3)
vec_6 = ClusterOutput(vec_4)
